# Dynamo graph ArchSmarter_06 Get Wall Type Count Length.dyn (Dynamo 2.13.1.3887)
# author: ArchSmarter
# Output wall types, lengths, and counter

# group: Get All Walls
categories = Categories("OST_Walls")  # graph input
all_elements_of_category = ElementsOfCategory(Category=categories)

# group: Sort By Wall Type
name = Element.Name()  # unwired: element
groupByFunction = List.GroupByFunction(list=all_elements_of_category, groupFunction=name)

# group: Get Wall Lengths
code_block = CodeBlock { "Length"; }
getParameterValueByName = Element.GetParameterValueByName(element=groupByFunction, parameterName=code_block)
sum = Math.Sum(values=getParameterValueByName)

# group: Get Wall Types and Counts
name_2 = Element.Name(element=groupByFunction)
uniqueItems = List.UniqueItems(list=name_2@L2)
flatten = List.Flatten(list=uniqueItems)
count = List.Count(list=name_2@L2)

# group: Output
# note: Wall Lengths
watch = Watch(sum)
# note: Wall Types
watch_2 = Watch(flatten)
# note: Wall Counts
watch_3 = Watch(count)
