# Dynamo graph ArchSmarter_07 Renumber Parking.dyn (Dynamo 2.13.1.3887)
# author: ArchSmarter
# Renumber parking spots using spline to determine desired number sequence

# group: Get Parking Elements and Geometry
categories = Categories("OST_Parking")  # graph input
all_elements_of_category = ElementsOfCategory(Category=categories)
geometry = Element.Geometry(element=all_elements_of_category)
code_block = CodeBlock { 0; }
getItemAtIndex = List.GetItemAtIndex(list=geometry@L2, index=code_block)

# group: Select Renumber Line and Extract Curve
select_model_element = DSModelElementSelection()  # nothing selected; graph input
curves = Element.Curves(element=select_model_element)

# group: Add Points Along Line
# note: Adjust this slider to control
# the density of cylinders
number_slider = DoubleSlider(250, range=0..250 step 1)  # graph input
pointsAtEqualChordLength = Curve.PointsAtEqualChordLength(curve=curves, divisions=number_slider)

# group: Create Upper and Lower Points
code_block_2 = CodeBlock { 1000; }
byCoordinates = Vector.ByCoordinates(z=code_block_2)
subtract = Point.Subtract(point=pointsAtEqualChordLength, vectorToSubtract=byCoordinates)
add = Point.Add(point=pointsAtEqualChordLength, vectorToAdd=byCoordinates)

# group: Create Cylinders and Look for Intersection with Line
# note: Set this value to 2 for
# Imperial models
code_block_3 = CodeBlock { 800; }
byPointsRadius = Cylinder.ByPointsRadius(startPoint=subtract, endPoint=add, radius=code_block_3)
flatten = List.Flatten(list=byPointsRadius)
doesIntersect = Geometry.DoesIntersect(geometry=flatten, other=getItemAtIndex, lacing=CrossProduct)

# group: Get Index Number of Intersecting Lines
boolean = BoolSelector(true)  # graph input
firstIndexOf = List.FirstIndexOf(list=doesIntersect@L2, item=boolean)
uniqueItems = List.UniqueItems(list=firstIndexOf)

# group: Remove Empty Values and Get Parking Spaces
code_block_4 = CodeBlock { -1; }
firstIndexOf_2 = List.FirstIndexOf(list=uniqueItems, item=code_block_4)
removeItemAtIndex = List.RemoveItemAtIndex(list=uniqueItems, indices=firstIndexOf_2)
getItemAtIndex_2 = List.GetItemAtIndex(list=all_elements_of_category, index=removeItemAtIndex)

# group: Generate Number Sequence
number = DoubleInput(1)  # graph input
count = List.Count(list=getItemAtIndex_2)
sequence = Sequence(start=number, amount=count)
string_from_object = FromObject(object=sequence)

# group: Update Parking Numbers
code_block_5 = CodeBlock { "Mark"; }
setParameterByName = Element.SetParameterByName(element=getItemAtIndex_2, parameterName=code_block_5, value=string_from_object)

# group: Add Prefix
# note: Use this node first then disconnect. Connect the "String from Object" node and re-run the script. This will prevent errors where two grid lines have the same number.
code_block_6 = CodeBlock(val=string_from_object) { "ZZZ" + val; }
