# Dynamo graph ArchSmarter_08 Create Sheets from Views.dyn (Dynamo 2.13.1.3887)
# author: ArchSmarter
# Create sheets from floor plan views
# packages: archi-lab.net 2023.213.1523

# group: Get All Views of Type
# note: Custom Node: archilab v.2023.213.1523
view_type = ViewTypesUi("FloorPlan")
getByType = archilab.Revit.Views.Views.GetByType(viewType=view_type)

# group: Sort By View Name
name = Element.Name()  # unwired: element
sortByFunction = List.SortByFunction(list=getByType, sortFunction=name)

# group: Set Sheet Name
name_2 = Element.Name(element=sortByFunction)
view_name_suffix = StringInput("Plan")  # graph input
code_block = CodeBlock(ViewName=name_2, Suffix=view_name_suffix) { ViewName + " " + Suffix; }

# group: Set Sheet Numbers
sheet_prefix = StringInput("A")  # graph input
starting_sheet_number = DoubleInput(101)  # graph input
count = List.Count(list=sortByFunction)
sequence = Sequence(start=starting_sheet_number, amount=count, lacing=Longest)
string_from_object = FromObject(object=sequence)
code_block_2 = CodeBlock(sheetPrefix=sheet_prefix, sheetNum=string_from_object) { sheetPrefix + sheetNum; }

# group: Create Sheets
# Select titleblock family using the "Family Types" node
family_types = FamilyTypes("A1 metric:A1 metric")  # graph input
byNameNumberTitleBlockAndView = Sheet.ByNameNumberTitleBlockAndView(sheetName=code_block, sheetNumber=code_block_2, titleBlockFamilyType=family_types, view=sortByFunction)
