# Dynamo graph ArchSmarter_Dynamo Template_v1.0 (R23 and later).dyn "ArchSmarter_Dynamo Template_2023" (Dynamo 2.16.2.5624)

# group: 1A. Get All By Category
# Use this option when your script file will only be used in a single version of Dynamo
categories = Categories("OST_Rooms")  # graph input
all_elements_of_category = ElementsOfCategory(Category=categories)

# group: 5A. Sort List by Parameter Value
# Use this group when you want to sort a list by a parameter, such as area, sheet number, room number, etc...
code_block = CodeBlock { "Number"; }
getParameterValueByName = Element.GetParameterValueByName(parameterName=code_block)  # unwired: element
sortByFunction = List.SortByFunction(sortFunction=getParameterValueByName)  # unwired: list

# group: 2B. Get Type Parameters
elementType = Element.ElementType()  # unwired: element
code_block_2 = CodeBlock { "Height"; "Width"; }
getParameterValueByName_2 = Element.GetParameterValueByName(element=elementType, parameterName=code_block_2.out0)
getParameterValueByName_3 = Element.GetParameterValueByName(element=elementType, parameterName=code_block_2.out1)

# group: 2A. Get Instance Parameters
code_block_3 = CodeBlock { "Number"; "Level"; "Area"; }
getParameterValueByName_4 = Element.GetParameterValueByName(parameterName=code_block_3.out1)  # unwired: element
getParameterValueByName_5 = Element.GetParameterValueByName(parameterName=code_block_3.out2)  # unwired: element
getParameterValueByName_6 = Element.GetParameterValueByName(parameterName=code_block_3.out0)  # unwired: element

# group: 6B. Export Data to CSV
# Use this group when Excel is not working. Exports to comma delimited txt file.
file_path = Filename("..\..\..\..\..\..\Desktop\test.csv")
exportCSV = Data.ExportCSV(filePath=file_path)  # unwired: data

# group: 1H. Select Single Element on Screen
select_model_element = DSModelElementSelection()  # nothing selected; graph input
select_model_element_by_category = DSModelElementByCategorySelection()  # nothing selected; nothing selected

# group: 1D. Get All Elements by Level
levels = Levels("01 - Entry Level")  # graph input
all_elements_at_level = ElementsAtLevel(Level=levels)

# group: 1F. Get All Instances of Family Type
family_types = FamilyTypes("A 8-5 x 11 Vertical:A 8.5 x 11 Vertical")  # graph input
all_elements_of_family_type = ElementsOfFamilyType(Family_Type=family_types)

# group: 4A. Filter List by Numeric Value
# Use this group when you need elements where a parameter value equals, is greater than, or less than, a specific number value
code_block_4 = CodeBlock { "Area"; "Number"; }
getParameterValueByName_7 = Element.GetParameterValueByName(parameterName=code_block_4.out0)  # unwired: element
code_block_5 = CodeBlock { 250; }
ge = getParameterValueByName_7 >= code_block_5
filterByBoolMask = List.FilterByBoolMask(mask=ge)  # unwired: list
eq = _ == _  # unwired: x, y

# group: 1E. Get All Elements in Active View
all_elements_in_active_view = ElementsInView()  # graph input

# group: 3A. Set Instance Parameters
code_block_6 = CodeBlock { "Comments"; }
code_block_7 = CodeBlock { "This is a test comment"; }
setParameterByName = Element.SetParameterByName(parameterName=code_block_6, value=code_block_7)  # unwired: element

# group: 3B. Set Type Parameters
elementType_2 = Element.ElementType()  # unwired: element
code_block_8 = CodeBlock { "Trim Width"; }
code_block_9 = CodeBlock { 100; }
setParameterByName_2 = Element.SetParameterByName(element=elementType_2, parameterName=code_block_8, value=code_block_9)

# group: Read Data from Excel
# Use the List.Transpose node to transpose the row based Excel data to columnar based lists
file_path_2 = Filename(".\test.xlsx")
file_from_path = FileObject(path=file_path_2)
code_block_10 = CodeBlock { "Sheet1"; }
boolean = BoolSelector(false)  # graph input
importExcel = Data.ImportExcel(file=file_from_path, sheetName=code_block_10, readAsStrings=boolean)
transpose = List.Transpose(lists=importExcel)

# group: Read Data from CSV File
# Use this group when Excel is not working
file_path_3 = Filename(".\test.xlsx")
file_from_path_2 = FileObject(path=file_path_3)
code_block_11 = CodeBlock { true; }
importCSV = Data.ImportCSV(filePath=file_from_path_2, transpose=code_block_11)

# group: 5B. Create List and Format
# Combine values or lists into a single list. Use List.Transpose to format data for export to Excel or import from Excel
code_block_12 = CodeBlock { ["A", "A", "A"]; ["B", "B", "B"]; ["C", "C", "C"]; ["D", "D", "D"]; }
create = List.Create(item0=code_block_12.out0, item1=code_block_12.out1, item2=code_block_12.out2, item3=code_block_12.out3)
transpose_2 = List.Transpose(lists=create)

# group: 1B. Get All By Category
# Use this option when your script file will used in multiple versions of Revit
code_block_13 = CodeBlock { "Rooms"; }
byName = Category.ByName(name=code_block_13)
all_elements_of_category_2 = ElementsOfCategory(Category=byName)

# group: 1C. Get All By Class
# In earlier versions of Dynamo (2022 and down), these nodes are Element Types and All Elements of Type
element_classes = ElementTypes("View")
all_elements_of_class = ElementsOfType(element_class=element_classes)

# group: 1G. Select Multiple Elements on Screen
select_model_elements = DSModelElementsSelection()  # 352 picked in the model
select_model_elements_by = DSModelElementsByCategorySelection()  # "Select Model Elements By Category"; nothing selected; nothing selected

# group: 4B. Filter by Category
# Use this group when you have a list of elements of mixed categories and want to filter the list to a specific category
getCategory = Element.GetCategory()  # unwired: element
string_from_object = FromObject(object=getCategory)
categories_2 = Categories("OST_Doors")  # graph input
string_from_object_2 = FromObject(object=categories_2)
eq_2 = string_from_object == string_from_object_2
filterByBoolMask_2 = List.FilterByBoolMask(mask=eq_2)  # unwired: list

# group: 6A. Export Data to Excel
# Connect nested list of data to "data" input
file_path_4 = Filename(".\test.xlsx")
code_block_14 = CodeBlock { "Sheet 1"; 0; true; false; }
exportToExcel = Data.ExportToExcel(filePath=file_path_4, sheetName=code_block_14.out0, startRow=code_block_14.out1, startColumn=code_block_14.out1, overWrite=code_block_14.out2, writeAsString=code_block_14.out3)  # unwired: data
