# Dynamo graph 01 Create Floor by Coordinate.dyn "01 Create Floor by Coor" (Dynamo 3.5.1.8731)

floor_types = FloorTypes("Concrete 150mm")
levels = Levels("WCS 0.0")
code_block = CodeBlock { 809793645; }
code_block_2 = CodeBlock(x=code_block) { x-809800000; }
code_block_3 = CodeBlock { 819303100; }
code_block_4 = CodeBlock(y=code_block_3) { y-819300000; }
code_block_5 = CodeBlock { 16120; }
byCoordinates = Point.ByCoordinates(x=code_block_2, y=code_block_4, z=code_block_5)
code_block_6 = CodeBlock { 809803100; }
code_block_7 = CodeBlock(x=code_block_6) { x-809800000; }
code_block_8 = CodeBlock { 819306355; }
code_block_9 = CodeBlock(y=code_block_8) { y-819300000; }
code_block_10 = CodeBlock { 16120; }
byCoordinates_2 = Point.ByCoordinates(x=code_block_7, y=code_block_9, z=code_block_10)
code_block_11 = CodeBlock { 809296900; }
code_block_12 = CodeBlock(x=code_block_11) { x-809800000; }
code_block_13 = CodeBlock { 819296900; }
code_block_14 = CodeBlock(y=code_block_13) { y-819300000; }
code_block_15 = CodeBlock { 16120; }
byCoordinates_3 = Point.ByCoordinates(x=code_block_12, y=code_block_14, z=code_block_15)
code_block_16 = CodeBlock { 809293645; }
code_block_17 = CodeBlock(x=code_block_16) { x-809800000; }
code_block_18 = CodeBlock { 819293645; }
code_block_19 = CodeBlock(y=code_block_18) { y-819300000; }
code_block_20 = CodeBlock { 16120; }
byCoordinates_4 = Point.ByCoordinates(x=code_block_17, y=code_block_19, z=code_block_20)
list_create = List.Create(item0=byCoordinates, item1=byCoordinates_2, item2=byCoordinates_3, item3=byCoordinates_4)
code_block_21 = CodeBlock { true; }
byPoints = PolyCurve.ByPoints(points=list_create, connectLastToFirst=code_block_21)
code_block_22 = CodeBlock { 0; }
code_block_23 = CodeBlock { 0; }
code_block_24 = CodeBlock { 0; }
byCoordinates_5 = Point.ByCoordinates(x=code_block_22, y=code_block_23, z=code_block_24)
ZAxis = Vector.ZAxis()
code_block_25 = CodeBlock { 341; }
rotate = Geometry.Rotate(geometry=byPoints, origin=byCoordinates_5, axis=ZAxis, degrees=code_block_25)
byOutlineTypeAndLevel = Floor.ByOutlineTypeAndLevel(outlineCurves=rotate)  # unwired: floorType, level
code_block_26 = CodeBlock { 0; }
code_block_27 = CodeBlock { 0; }
code_block_28 = CodeBlock { 1; }
byCoordinates_6 = Vector.ByCoordinates(x=code_block_26, y=code_block_27, z=code_block_28)
code_block_29 = CodeBlock { 341; }
family_types = FamilyTypes("M_Base Cabinet-Built In:664mm")
byPoint = FamilyInstance.ByPoint()  # unwired: familyType, point
setRotation = FamilyInstance.SetRotation()  # unwired: familyInstance, degree
