# Dynamo graph 02 Place Adaptive Family by point.dyn "Place Adaptive Family by point" (Dynamo 2.10.1.3976)

file_path = Filename("..\..\..\02 BIM Model\02 Marine Viaduct\02 STR\XX-Family\Tendon profile.xlsx")
file_from_path = FileObject(path=file_path)
string = StringInput("Sheet3")
boolean = BoolSelector(true)
boolean_2 = BoolSelector(true)
importExcel = Data.ImportExcel(file=file_from_path, sheetName=string, readAsStrings=boolean, showExcel=boolean_2)
restOfItems = List.RestOfItems(list=importExcel)
transpose = List.Transpose(lists=restOfItems)
restOfItems_2 = List.RestOfItems(list=transpose)
restOfItems_3 = List.RestOfItems(list=restOfItems_2)
restOfItems_4 = List.RestOfItems(list=restOfItems_3)
toNumber = String.ToNumber(str=restOfItems_4)
number = DoubleInput(3)
chop = List.Chop(list=toNumber, lengths=number)
transpose_2 = List.Transpose(lists=chop@L3)
code_block = CodeBlock { 0; }
getItemAtIndex = List.GetItemAtIndex(list=transpose_2, index=code_block)
transpose_3 = List.Transpose(lists=getItemAtIndex)
code_block_2 = CodeBlock { 0; }
getItemAtIndex_2 = List.GetItemAtIndex(list=transpose_3, index=code_block_2)
code_block_3 = CodeBlock { 1; }
getItemAtIndex_3 = List.GetItemAtIndex(list=transpose_3, index=code_block_3)
code_block_4 = CodeBlock { 2; }
getItemAtIndex_4 = List.GetItemAtIndex(list=transpose_3, index=code_block_4)
byCoordinates = Point.ByCoordinates(x=getItemAtIndex_2, y=getItemAtIndex_3, z=getItemAtIndex_4)
code_block_5 = CodeBlock { 1; }
getItemAtIndex_5 = List.GetItemAtIndex(list=transpose_2, index=code_block_5)
transpose_4 = List.Transpose(lists=getItemAtIndex_5)
code_block_6 = CodeBlock { 0; }
getItemAtIndex_6 = List.GetItemAtIndex(list=transpose_4, index=code_block_6)
code_block_7 = CodeBlock { 1; }
getItemAtIndex_7 = List.GetItemAtIndex(list=transpose_4, index=code_block_7)
code_block_8 = CodeBlock { 2; }
getItemAtIndex_8 = List.GetItemAtIndex(list=transpose_4, index=code_block_8)
byCoordinates_2 = Point.ByCoordinates(x=getItemAtIndex_6, y=getItemAtIndex_7, z=getItemAtIndex_8)
list_create = List.Create(item0=byCoordinates, item1=byCoordinates_2)
transpose_5 = List.Transpose(lists=list_create)
family_types = FamilyTypes()  # nothing selected
byPoints = AdaptiveComponent.ByPoints(points=transpose_5, familyType=family_types)  # frozen
family_types_2 = FamilyTypes()  # nothing selected
byCoordinates_3 = FamilyInstance.ByCoordinates(familyType=family_types_2, x=getItemAtIndex_2, y=getItemAtIndex_3)
code_block_9 = CodeBlock { 17; }
getItemAtIndex_9 = List.GetItemAtIndex(list=transpose, index=code_block_9)
toNumber_2 = String.ToNumber(str=getItemAtIndex_9)
setRotation = FamilyInstance.SetRotation(familyInstance=byCoordinates_3, degree=toNumber_2)
code_block_10 = CodeBlock { "P1"; }
setParameterByName = Element.SetParameterByName(element=setRotation@L1, parameterName=code_block_10, value=getItemAtIndex_4@L1)
code_block_11 = CodeBlock { "P2"; }
setParameterByName_2 = Element.SetParameterByName(element=setParameterByName@L1, parameterName=code_block_11, value=getItemAtIndex_8@L1)
code_block_12 = CodeBlock { "Mark"; }
code_block_13 = CodeBlock { 0; }
getItemAtIndex_10 = List.GetItemAtIndex(list=transpose, index=code_block_13)
setParameterByName_3 = Element.SetParameterByName(element=setParameterByName_2@L1, parameterName=code_block_12, value=getItemAtIndex_10@L1)
code_block_14 = CodeBlock { "Segment Name"; }
code_block_15 = CodeBlock { 1; }
getItemAtIndex_11 = List.GetItemAtIndex(list=transpose, index=code_block_15)
setParameterByName_4 = Element.SetParameterByName(element=setParameterByName_3@L1, parameterName=code_block_14, value=getItemAtIndex_11@L1)
code_block_16 = CodeBlock { "Tendon Name"; }
code_block_17 = CodeBlock { 2; }
getItemAtIndex_12 = List.GetItemAtIndex(list=transpose, index=code_block_17)
setParameterByName_5 = Element.SetParameterByName(element=setParameterByName_4@L1, parameterName=code_block_16, value=getItemAtIndex_12@L1)
code_block_18 = CodeBlock { "Crossfall Start"; }
toNumber_3 = String.ToNumber(str=transpose)
code_block_19 = CodeBlock { 9; }
getItemAtIndex_13 = List.GetItemAtIndex(list=toNumber_3, index=code_block_19)
setParameterByName_6 = Element.SetParameterByName(element=setParameterByName_5@L1, parameterName=code_block_18, value=getItemAtIndex_13@L1)
code_block_20 = CodeBlock { "Crossfall End"; }
code_block_21 = CodeBlock { 10; }
getItemAtIndex_14 = List.GetItemAtIndex(list=toNumber_3, index=code_block_21)
setParameterByName_7 = Element.SetParameterByName(element=setParameterByName_6@L1, parameterName=code_block_20, value=getItemAtIndex_14@L1)
code_block_22 = CodeBlock { "Segment Plan Length"; }
code_block_23 = CodeBlock { 16; }
getItemAtIndex_15 = List.GetItemAtIndex(list=toNumber_3, index=code_block_23)
setParameterByName_8 = Element.SetParameterByName(element=setParameterByName_7@L1, parameterName=code_block_22, value=getItemAtIndex_15@L1)
code_block_24 = CodeBlock { "Segment Angle Start"; }
code_block_25 = CodeBlock { 12; }
getItemAtIndex_16 = List.GetItemAtIndex(list=toNumber_3, index=code_block_25)
setParameterByName_9 = Element.SetParameterByName(element=setParameterByName_8@L1, parameterName=code_block_24, value=getItemAtIndex_16@L1)
code_block_26 = CodeBlock { "Segment Angle End"; }
code_block_27 = CodeBlock { 13; }
getItemAtIndex_17 = List.GetItemAtIndex(list=toNumber_3, index=code_block_27)
setParameterByName_10 = Element.SetParameterByName(element=setParameterByName_9@L1, parameterName=code_block_26, value=getItemAtIndex_17@L1)
code_block_28 = CodeBlock { "Tendon Start offset"; }
code_block_29 = CodeBlock { 14; }
getItemAtIndex_18 = List.GetItemAtIndex(list=toNumber_3, index=code_block_29)
setParameterByName_11 = Element.SetParameterByName(element=setParameterByName_10@L1, parameterName=code_block_28, value=getItemAtIndex_18@L1)
code_block_30 = CodeBlock { "Tendon End offset"; }
code_block_31 = CodeBlock { 15; }
getItemAtIndex_19 = List.GetItemAtIndex(list=toNumber_3, index=code_block_31)
setParameterByName_12 = Element.SetParameterByName(element=setParameterByName_11@L1, parameterName=code_block_30, value=getItemAtIndex_19@L1)
code_block_32 = CodeBlock { "Tendon X-0"; }
code_block_33 = CodeBlock { 18; }
getItemAtIndex_20 = List.GetItemAtIndex(list=toNumber_3, index=code_block_33)
setParameterByName_13 = Element.SetParameterByName(element=setParameterByName_12@L1, parameterName=code_block_32, value=getItemAtIndex_20@L1)
code_block_34 = CodeBlock { "Tendon X-1"; }
code_block_35 = CodeBlock { 19; }
getItemAtIndex_21 = List.GetItemAtIndex(list=toNumber_3, index=code_block_35)
setParameterByName_14 = Element.SetParameterByName(element=setParameterByName_13@L1, parameterName=code_block_34, value=getItemAtIndex_21@L1)
code_block_36 = CodeBlock { "Tendon X-2"; }
code_block_37 = CodeBlock { 20; }
getItemAtIndex_22 = List.GetItemAtIndex(list=toNumber_3, index=code_block_37)
setParameterByName_15 = Element.SetParameterByName(element=setParameterByName_14@L1, parameterName=code_block_36, value=getItemAtIndex_22@L1)
code_block_38 = CodeBlock { "Tendon Y-0"; }
code_block_39 = CodeBlock { 21; }
getItemAtIndex_23 = List.GetItemAtIndex(list=toNumber_3, index=code_block_39)
setParameterByName_16 = Element.SetParameterByName(element=setParameterByName_15@L1, parameterName=code_block_38, value=getItemAtIndex_23@L1)
code_block_40 = CodeBlock { "Tendon Y-1"; }
code_block_41 = CodeBlock { 22; }
getItemAtIndex_24 = List.GetItemAtIndex(list=toNumber_3, index=code_block_41)
setParameterByName_17 = Element.SetParameterByName(element=setParameterByName_16@L1, parameterName=code_block_40, value=getItemAtIndex_24@L1)
code_block_42 = CodeBlock { "Tendon Y-2"; }
code_block_43 = CodeBlock { 23; }
getItemAtIndex_25 = List.GetItemAtIndex(list=toNumber_3, index=code_block_43)
setParameterByName_18 = Element.SetParameterByName(element=setParameterByName_17@L1, parameterName=code_block_42, value=getItemAtIndex_25@L1)
code_block_44 = CodeBlock { 0; }
getItemAtIndex_26 = List.GetItemAtIndex(list=transpose_5, index=code_block_44)
code_block_45 = CodeBlock { 1; }
getItemAtIndex_27 = List.GetItemAtIndex(list=transpose_5, index=code_block_45)
list_create_2 = List.Create(item0=getItemAtIndex_26, item1=getItemAtIndex_27)
code_block_46 = CodeBlock { "Tendon X-6"; }
code_block_47 = CodeBlock { 24; }
getItemAtIndex_28 = List.GetItemAtIndex(list=toNumber_3, index=code_block_47)
setParameterByName_19 = Element.SetParameterByName(parameterName=code_block_46, value=getItemAtIndex_28@L1)  # frozen; unwired: element
code_block_48 = CodeBlock { "Tendon X-7"; }
code_block_49 = CodeBlock { 25; }
getItemAtIndex_29 = List.GetItemAtIndex(list=toNumber_3, index=code_block_49)
setParameterByName_20 = Element.SetParameterByName(element=setParameterByName_19@L1, parameterName=code_block_48, value=getItemAtIndex_29@L1)
code_block_50 = CodeBlock { "Tendon Y-1"; }
code_block_51 = CodeBlock { 26; }
getItemAtIndex_30 = List.GetItemAtIndex(list=toNumber_3, index=code_block_51)
setParameterByName_21 = Element.SetParameterByName(element=setParameterByName_20@L1, parameterName=code_block_50, value=getItemAtIndex_30@L1)
code_block_52 = CodeBlock { "Tendon Y-2"; }
code_block_53 = CodeBlock { 27; }
getItemAtIndex_31 = List.GetItemAtIndex(list=toNumber_3, index=code_block_53)
setParameterByName_22 = Element.SetParameterByName(element=setParameterByName_21@L1, parameterName=code_block_52, value=getItemAtIndex_31@L1)
code_block_54 = CodeBlock { "Tendon Y-3"; }
code_block_55 = CodeBlock { 28; }
getItemAtIndex_32 = List.GetItemAtIndex(list=toNumber_3, index=code_block_55)
setParameterByName_23 = Element.SetParameterByName(element=setParameterByName_22@L1, parameterName=code_block_54, value=getItemAtIndex_32@L1)
code_block_56 = CodeBlock { "Tendon Y-4"; }
code_block_57 = CodeBlock { 29; }
getItemAtIndex_33 = List.GetItemAtIndex(list=toNumber_3, index=code_block_57)
setParameterByName_24 = Element.SetParameterByName(element=setParameterByName_23@L1, parameterName=code_block_56, value=getItemAtIndex_33@L1)
code_block_58 = CodeBlock { "Tendon Y-5"; }
code_block_59 = CodeBlock { 30; }
getItemAtIndex_34 = List.GetItemAtIndex(list=toNumber_3, index=code_block_59)
setParameterByName_25 = Element.SetParameterByName(element=setParameterByName_24@L1, parameterName=code_block_58, value=getItemAtIndex_34@L1)
code_block_60 = CodeBlock { "Tendon Y-6"; }
code_block_61 = CodeBlock { 31; }
getItemAtIndex_35 = List.GetItemAtIndex(list=toNumber_3, index=code_block_61)
setParameterByName_26 = Element.SetParameterByName(element=setParameterByName_25@L1, parameterName=code_block_60, value=getItemAtIndex_35@L1)
code_block_62 = CodeBlock { "Tendon Y-7"; }
code_block_63 = CodeBlock { 32; }
getItemAtIndex_36 = List.GetItemAtIndex(list=toNumber_3, index=code_block_63)
setParameterByName_27 = Element.SetParameterByName(element=setParameterByName_26@L1, parameterName=code_block_62, value=getItemAtIndex_36@L1)
