# Dynamo graph 04 Angle to True North.dyn (Dynamo 2.19.3.6394)

categories = Categories("OST_ProjectBasePoint")
all_elements_of_category = ElementsOfCategory(Category=categories)
code_block = CodeBlock { "Angle to True North"; }
getParameterValueByName = Element.GetParameterValueByName(element=all_elements_of_category, parameterName=code_block)
select_model_element = DSModelElementSelection()  # 1 picked in the model
code_block_2 = CodeBlock { 0; }
setParameterByName = Element.SetParameterByName(element=all_elements_of_category, parameterName=code_block, value=code_block_2)
