# Dynamo graph 00 AA Coordinate System Transform.dyn "AA CS Transform" (Dynamo 2.19.3.6394)

categories = Categories("OST_SharedBasePoint")
categories_2 = Categories("OST_CoordinateSystem")

# group: Get Project Base Point Coord
categories_3 = Categories("OST_ProjectBasePoint")
all_elements_of_category = ElementsOfCategory(Category=categories_3)
code_block = CodeBlock { "E/W"; }
getParameterValueByName = Element.GetParameterValueByName(element=all_elements_of_category, parameterName=code_block)
code_block_2 = CodeBlock { "N/S"; }
getParameterValueByName_2 = Element.GetParameterValueByName(element=all_elements_of_category, parameterName=code_block_2)
code_block_3 = CodeBlock { "Angle to True North"; }
getParameterValueByName_3 = Element.GetParameterValueByName(element=all_elements_of_category, parameterName=code_block_3)

# group: Create CS for Revit Internal Origin (CS Translate)
code_block_os_coord_input = CodeBlock { 809800000; 819300000; }
sub = getParameterValueByName - code_block_os_coord_input.out0
sub_2 = getParameterValueByName_2 - code_block_os_coord_input.out1
byOrigin = CoordinateSystem.ByOrigin(x=sub, y=sub_2)
identity = CoordinateSystem.Identity()
origin = CoordinateSystem.Origin(coordinateSystem=identity)
ZAxis = CoordinateSystem.ZAxis(coordinateSystem=identity)
code_block_4 = CodeBlock(rot=getParameterValueByName_3) { rot-341; }
rotate = CoordinateSystem.Rotate(coordinateSystem=byOrigin, origin=origin, axis=ZAxis, degrees=code_block_4)

# group: Place Family
family_types = FamilyTypes("AA-Furniture_Desks:Rectangle")
byCoordinateSystem = FamilyInstance.ByCoordinateSystem(familyType=family_types, coordinateSystem=rotate)

parameters = Element.Parameters(element=all_elements_of_category)
