# Dynamo graph 01 Move Element from Project Base Point to Survey Point.dyn "Survey Point and Project Base Point Transform" (Dynamo 2.19.3.6394)

surveyPoint = Coordinates.SurveyPoint()
basePoint = Coordinates.BasePoint()
code_block = CodeBlock { ["E/W","N/S","Elev","Angle to True North"]; }

# group: Survey Point
categories = Categories("OST_SharedBasePoint")
all_elements_of_category = ElementsOfCategory(Category=categories)
getParameterValueByName = Element.GetParameterValueByName(element=all_elements_of_category, parameterName=code_block, lacing=Longest)

# group: Draw line
origin = Point.Origin()
YAxis = Vector.YAxis()
number = DoubleInput(15000)
byStartPointDirectionLength = Line.ByStartPointDirectionLength(startPoint=origin, direction=YAxis, length=number)

# group: Project Base Point
categories_2 = Categories("OST_ProjectBasePoint")
all_elements_of_category_2 = ElementsOfCategory(Category=categories_2)
getParameterValueByName_2 = Element.GetParameterValueByName(element=all_elements_of_category_2, parameterName=code_block, lacing=Longest)

# group: Form the coordinate system according to the input
code_block_2 = CodeBlock(p=getParameterValueByName_2) { p[0]; p[1]; p[2]; p[3]; }
byCoordinates = Point.ByCoordinates(x=code_block_2.out0, y=code_block_2.out1, z=code_block_2.out2)
byOriginNormal = Plane.ByOriginNormal(origin=byCoordinates)
byPlane = CoordinateSystem.ByPlane(plane=byOriginNormal)

identity = CoordinateSystem.Identity()
transform = Geometry.Transform(geometry=byStartPointDirectionLength, fromCoordinateSystem=byPlane, contextCoordinateSystem=identity)
byCurve = ModelCurve.ByCurve(curve=transform)
