# Dynamo graph 01 Point from Survey Coordinates to Project Coordinates.dyn "Model Origin Survey Coordinates" (Dynamo 2.19.3.6394)

# group: Gets Location in relation to Revits origin
surveyPoint = Coordinates.SurveyPoint()
byOrigin = CoordinateSystem.ByOrigin(origin=surveyPoint)
basePoint = Coordinates.BasePoint()

# group: Get project base point data
categories = Categories("OST_ProjectBasePoint")  # graph input
all_elements_of_category = ElementsOfCategory(Category=categories)
code_block = CodeBlock()
# ---------- code_block.designscript (4 lines) ----------
["E/W",
"N/S",
"Elev",
"Angle to True North"];
# ----------------------------------------
getParameterValueByName = Element.GetParameterValueByName(element=all_elements_of_category, parameterName=code_block, lacing=Longest)
code_block_2 = CodeBlock(bp=getParameterValueByName) { bp[0]; bp[1]; bp[2]; bp[3]; }

# group: Rotates coordinate system to match north point rotation.
ZAxis = Vector.ZAxis()
rotate = CoordinateSystem.Rotate(coordinateSystem=byOrigin, origin=surveyPoint, axis=ZAxis, degrees=code_block_2.out3)

# group: This is the location of revits origin 0,0,0
identity = CoordinateSystem.Identity()

# group: gets model origin, converts to survey coordinates and extracts x /y values
code_block_3 = CodeBlock { 100; }
byCoordinates = Point.ByCoordinates(x=code_block_3, y=code_block_3)
transform = Geometry.Transform(geometry=byCoordinates, fromCoordinateSystem=rotate, contextCoordinateSystem=identity)
X = Point.X(point=transform)
code_block_4 = CodeBlock { 1; }
round = Math.Round(number=X, digits=code_block_4)
Y = Point.Y(point=transform)
round_2 = Math.Round(number=Y, digits=code_block_4)
create = List.Create(item0=round, item1=round_2)
flatten = List.Flatten(list=create)
