# Dynamo graph 02 Place North Arrow.dyn "North Arrow" (Dynamo 2.19.3.6394)

watch = Watch()  # unwired: arg0
watch_2 = Watch()  # unwired: arg0

# group: Get North Arrow Family and Set Rotation to 0
family_types = FamilyTypes("AA-Furniture_Chair:Desk Chair")
all_elements_of_family_type = ElementsOfFamilyType(Family_Type=family_types)
code_block = CodeBlock { 0; }
setRotation = FamilyInstance.SetRotation(familyInstance=all_elements_of_family_type, degree=code_block)

code_block_2 = CodeBlock { "Angle to True North"; }

# group: Get Project Base Point Rotation
categories = Categories("OST_ProjectBasePoint")
all_elements_of_category = ElementsOfCategory(Category=categories)
getParameterValueByName = Element.GetParameterValueByName(element=all_elements_of_category, parameterName=code_block_2)

setParameterByName = Element.SetParameterByName(element=setRotation, parameterName=code_block_2, value=getParameterValueByName)
watch_3 = Watch(getParameterValueByName)

# group: Get Project Base Point Rotation(Abbandon)
element_types = ElementTypes("BasePoint")
all_elements_of_type = ElementsOfType(element_class=element_types)
code_block_3 = CodeBlock { 1; }
getItemAtIndex = List.GetItemAtIndex(list=all_elements_of_type, index=code_block_3)
getParameterValueByName_2 = Element.GetParameterValueByName(element=getItemAtIndex)  # unwired: parameterName
parameters = Element.Parameters(element=all_elements_of_type)
