# Dynamo graph Element locations from different coordinate systems.dyn (Dynamo 2.19.3.6394)

# group: 1st Element
select_model_element = DSModelElementSelection()  # 1 picked in the model; graph input

# group: Gets location of an element in relation to revits Origin
location = FamilyInstance.Location(familyInstance=select_model_element)
watch = Watch(location)

# group: Gets the Location of Base point in relation to revits Origin
basePoint = Coordinates.BasePoint()
byOrigin = CoordinateSystem.ByOrigin(origin=basePoint)

# group: This is the location of revits origin 0,0,0
identity = CoordinateSystem.Identity()

# group: Transforms gemoerty from one coordinate system to another, in this case it moves the element location point to the base point coordinate system
transform = Geometry.Transform(geometry=location, fromCoordinateSystem=byOrigin, contextCoordinateSystem=identity)
watch_2 = Watch(transform)

# group: Gets Location in relation to Revits origin
surveyPoint = Coordinates.SurveyPoint()
byOrigin_2 = CoordinateSystem.ByOrigin(origin=surveyPoint)

# group: Transforms gemoerty from one coordinate system to another, in this case it moves the element location point to the Survey point coordinate system
transform_2 = Geometry.Transform(geometry=location, fromCoordinateSystem=byOrigin_2, contextCoordinateSystem=identity)
watch_3 = Watch(transform_2)

# group: 2nd element
select_model_element_2 = DSModelElementSelection()  # 1 picked in the model; graph input

location_2 = FamilyInstance.Location(familyInstance=select_model_element_2)
byOrigin_3 = CoordinateSystem.ByOrigin(origin=watch)

# group: Transforms gemoerty from one coordinate system to another, in this case it moves the location of the second element on the a new coordinate system that has been created at the location of the 1st element
transform_3 = Geometry.Transform(geometry=location_2, fromCoordinateSystem=byOrigin_3, contextCoordinateSystem=identity)
watch_4 = Watch(transform_3)
