# Dynamo graph Example Coords Definition-Vikram-adjusted.dyn (Dynamo 2.19.3.6394)

# group: Select the Spline line path
select_curve = DSModelElementSelection()  # 1 picked in the model; graph input
curve = CurveElement.Curve(curveElement=select_curve)
code_block = CodeBlock { 500; }
pointsAtEqualSegmentLength = Curve.PointsAtEqualSegmentLength(curve=curve, divisions=code_block)

# group: Filter the Target Instances
categories = Categories("OST_Doors")  # graph input
all_elements_of_category = ElementsOfCategory(Category=categories)
string_from_object = FromObject(object=all_elements_of_category)
pile_type_name = CodeBlock { "900x2100mm"; }
eq = string_from_object == pile_type_name
filterByBoolMask = List.FilterByBoolMask(list=all_elements_of_category, mask=eq)

# group: Filter the Spline Path Points within the Bounding Box
boundingBox = Geometry.BoundingBox(geometry=filterByBoolMask.in)
contains = BoundingBox.Contains(boundingBox=boundingBox)  # unwired: point
map = List.Map(list=pointsAtEqualSegmentLength, function=contains)
filterByBoolMask_2 = List.FilterByBoolMask(list=filterByBoolMask.in)  # unwired: mask
map_2 = List.Map(list=map, function=filterByBoolMask_2.in)

flatten = List.Flatten(list=map_2)
uniqueItems = List.UniqueItems(list=flatten)

# group: Instance parameter to populate
code_block_2 = CodeBlock { "Mark"; }

# group: The # the Mark starts from
start_mark_from = CodeBlock { 1; }

count = List.Count(list=uniqueItems)
code_block_3 = CodeBlock(a=start_mark_from, x=count) { a..#x..1; }
string_from_object_2 = FromObject(object=code_block_3)
mark_settings = CodeBlock()
# ---------- mark_settings.designscript (4 lines) ----------
// # of chars
3;
// pad with
"0";
# ----------------------------------------
padLeft = String.PadLeft(string=string_from_object_2, newLength=mark_settings.out0, padChars=mark_settings.out1)

# group: ID # format
prefix1 = CodeBlock()
# ---------- prefix1.designscript (2 lines) ----------
//Piles
"P";
# ----------------------------------------
seperator = CodeBlock { "."; }

code_block_4 = CodeBlock(Mark=padLeft, prefix1=prefix1, seperator=seperator) { Mark; prefix1; seperator; prefix1+seperator+Mark; }
setParameterByName = Element.SetParameterByName(element=uniqueItems, parameterName=code_block_2, value=code_block_4.out3)
code_block_5 = CodeBlock { "Coord_X"; "Coord_Y"; "Coord_Z"; }
location = FamilyInstance.Location(familyInstance=uniqueItems)
identity = CoordinateSystem.Identity()

# group: Get Base Point Info
element_types = ElementTypes("BasePoint")  # graph input
all_elements_of_type = ElementsOfType(element_class=element_types)
lastItem = List.LastItem(list=all_elements_of_type)
code_block_6 = CodeBlock { ["E/W","N/S","Elev","Angle to True North"]; }
getParameterValueByName = Element.GetParameterValueByName(element=lastItem, parameterName=code_block_6)
code_block_7 = CodeBlock(bp=getParameterValueByName) { bp[0]; bp[1]; bp[2]; 360-bp[3]; }
byOrigin = CoordinateSystem.ByOrigin(x=code_block_7.out0, y=code_block_7.out1, z=code_block_7.out2)
origin = CoordinateSystem.Origin(coordinateSystem=byOrigin)
parameters = Element.Parameters(element=all_elements_of_type)

ZAxis = Vector.ZAxis()
rotate = CoordinateSystem.Rotate(coordinateSystem=byOrigin, origin=origin, axis=ZAxis, degrees=code_block_7.out3)
transform = Geometry.Transform(geometry=location, fromCoordinateSystem=identity, contextCoordinateSystem=rotate)
X = Point.X(point=transform)
round = Math.Round(number=X)
setParameterByName_2 = Element.SetParameterByName(element=uniqueItems, parameterName=code_block_5.out0, value=round)
watch = Watch(code_block_4.out3)
Z = Point.Z(point=transform)
round_2 = Math.Round(number=Z)
setParameterByName_3 = Element.SetParameterByName(element=uniqueItems, parameterName=code_block_5.out2, value=round_2)
Y = Point.Y(point=transform)
round_3 = Math.Round(number=Y)
setParameterByName_4 = Element.SetParameterByName(element=uniqueItems, parameterName=code_block_5.out1, value=round_3)
