# Dynamo graph 2.0.4-Extract_Project_Coordinate_Data-0.3.7-original.dyn "2.0.4-Extract_Project_Coordinate_Data-0.3.7" (Dynamo 2.0.4.12684)

# group: Gets level names and filters for 'Building Storey'
categories = Categories(index=227)  # graph input
all_elements_of_category = ElementsOfCategory(Category=categories)
code_block = CodeBlock { "Building Story"; }
getParameterValueByName = Element.GetParameterValueByName(element=all_elements_of_category, parameterName=code_block)
code_block_2 = CodeBlock { 1; }
eq = getParameterValueByName == code_block_2

# group: Get User Input Data
code_block_3 = CodeBlock { "Settings"; }
file_path = Filename("..\..\..\Pictures\jmdigital-Sml-Grey.png")
file_from_path = FileObject(path=file_path)
readFromFile = Image.ReadFromFile(file=file_from_path)
code_block_4 = CodeBlock { "Extract Coordinates"; }
code_block_5 = CodeBlock { "Record File"; }
# note: Custom Node: Data-Shapes v.2019.2.33
ui_filepath_data = Custom[UI.FilePath Data](InputName=code_block_5)  # Create filepath input for UI.MultipleInputForm ++ . Check out www.data-shapes.net for more infos !
code_block_6 = CodeBlock { "Model Discipline"; }
code_block_7 = CodeBlock { ["ARC","STR","MEP","MEC","ELE","PLU","FFE","LAN"]; }
code_block_8 = CodeBlock { 1; }
boolean = BoolSelector(false)  # graph input
ui_dropdown_data = Custom[UI.DropDown Data](InputName=code_block_6, Keys=code_block_7, Values=code_block_7, DefaultValueIndex=code_block_8, Sorted_optional=boolean)  # Create data for DropDown input in UI.MultiInputForm ++ . Check out www.data-shapes.net for more infos.
code_block_9 = CodeBlock { "X Grid Reference"; "A"; }
ui_textbox_data = Custom[UI.TextBox Data](InputName=code_block_9.out0, DefaultText=code_block_9.out1)  # Create Data for TextBox input in UI.MultipleInputForm ++ . Check out www.data-shapes.net for more informations
code_block_10 = CodeBlock { "Y Grid Reference"; "01"; }
ui_textbox_data_2 = Custom[UI.TextBox Data](InputName=code_block_10.out0, DefaultText=code_block_10.out1)
code_block_11 = CodeBlock { "Tekla Origin X Grid"; "A"; }
ui_textbox_data_3 = Custom[UI.TextBox Data](InputName=code_block_11.out0, DefaultText=code_block_11.out1)
code_block_12 = CodeBlock { "Tekla Origin Y Grid"; "01"; }
ui_textbox_data_4 = Custom[UI.TextBox Data](InputName=code_block_12.out0, DefaultText=code_block_12.out1)
code_block_13 = CodeBlock { "Level at Tekla Origin"; "0.0000"; }
ui_textbox_data_5 = Custom[UI.TextBox Data](InputName=code_block_13.out0, DefaultText=code_block_13.out1)
code_block_14 = CodeBlock { "Rotation from Project North"; "0.0000"; }
ui_textbox_data_6 = Custom[UI.TextBox Data](InputName=code_block_14.out0, DefaultText=code_block_14.out1)
create = List.Create(item0=ui_filepath_data, item1=ui_dropdown_data, item2=ui_textbox_data, item3=ui_textbox_data_2, item4=ui_textbox_data_3, item5=ui_textbox_data_4, item6=ui_textbox_data_5, item7=ui_textbox_data_6)
boolean_2 = BoolSelector(true)  # graph input
code_block_15 = CodeBlock { "Cancel"; }
ui_multipleinputform = Custom[UI.MultipleInputForm ++](Description_optional=code_block_3, Logo_optional=readFromFile, ButtonText_optional=code_block_4, Inputs=create, Toggle=boolean_2, CancelButtonText_optional=code_block_15)  # Create a form with multiple inputs. see www.data-shapes.net for tutorials and infos!
code_block_16 = CodeBlock(x=ui_multipleinputform.User_Inputs)
# ---------- code_block_16.designscript (11 lines) ----------
x[0];
x[1];
x[1];
x[2];
x[3];
x[4];
x[5];
//Tekla Base Level
x[6];
//Rotation from Project North
x[7];
# ----------------------------------------
code_block_17 = CodeBlock()
# ---------- code_block_17.designscript (3 lines) ----------
["ARC","STR","MEP","MEC","ELE","PLU","FFE","LAN"];
["ARC Summary","STR Summary","MEP Summary","MEC Summary","ELE Summary","PLU Summary","FFE Summary","LAN Summary"];
["ARC Record","STR Record","MEP Record","MEC Record","ELE Record","PLU Record","FFE Record","LAN Record"];
# ----------------------------------------
byKeysValues = DesignScript.Builtin.Dictionary.ByKeysValues(keys=code_block_17.out0, values=code_block_17.out1)
valueAtKey = DesignScript.Builtin.Dictionary.ValueAtKey(dictionary=byKeysValues, key=code_block_16.out2)
byKeysValues_2 = DesignScript.Builtin.Dictionary.ByKeysValues(keys=code_block_17.out0, values=code_block_17.out2)
valueAtKey_2 = DesignScript.Builtin.Dictionary.ValueAtKey(dictionary=byKeysValues_2, key=code_block_16.out2)

# group: Get Project Base Point Data
element_types = ElementTypes(index=26)  # graph input
all_elements_of_type = ElementsOfType(element_type=element_types)
lastItem = List.LastItem(list=all_elements_of_type)
code_block_18 = CodeBlock()
# ---------- code_block_18.designscript (2 lines) ----------
["E/W","N/S","Elev",
"Angle to True North"];
# ----------------------------------------
getParameterValueByName_2 = Element.GetParameterValueByName(element=lastItem, parameterName=code_block_18)
code_block_19 = CodeBlock(bp=getParameterValueByName_2) { bp[0]; bp[1]; bp[2]; 360-bp[3]; bp[3]; }
byOrigin = CoordinateSystem.ByOrigin(x=code_block_19.out0, y=code_block_19.out1, z=code_block_19.out2)
byCoordinates = Point.ByCoordinates(x=code_block_19.out0, y=code_block_19.out1, z=code_block_19.out2)
ZAxis = Vector.ZAxis()
rotate = CoordinateSystem.Rotate(coordinateSystem=byOrigin, origin=byCoordinates, axis=ZAxis, degrees=code_block_19.out3)

# group: Gets level name, project elevation and survey elevation
elevation = Level.Elevation(level=all_elements_of_category)
code_block_20 = CodeBlock { "Name"; }
getParameterValueByName_3 = Element.GetParameterValueByName(element=all_elements_of_category, parameterName=code_block_20)
projectElevation = Level.ProjectElevation(level=all_elements_of_category)
add = projectElevation + code_block_19.out2
create_2 = List.Create(item0=getParameterValueByName_3, item1=add, item2=projectElevation)

# group: Filter list, sot and group data
filterByBoolMask = List.FilterByBoolMask(mask=eq)  # unwired: list
map = List.Map(list=create_2, f_x=filterByBoolMask.in)
transpose = List.Transpose(lists=map)
code_block_21 = CodeBlock(x=map) { x[0]; }
sortByKey = List.SortByKey(list=transpose, keys=code_block_21)

# group: Write Level data to excel
code_block_22 = CodeBlock { 16; }
code_block_23 = CodeBlock { 2; }
exportExcel = Data.ExportExcel(filePath=code_block_16.out0, sheetName=valueAtKey, startRow=code_block_22, startCol=code_block_23, data=sortByKey.sorted_list)

# group: Generated coordinate system from PBP model coordinates
basePoint = Coordinates.BasePoint()
adj_point_x = Point.X(point=basePoint)
opp_point_y = Point.Y(point=basePoint)
code_block_24 = CodeBlock { 0; }
byOrigin_2 = CoordinateSystem.ByOrigin(x=adj_point_x, y=opp_point_y, z=code_block_24)

# group: Transform Origin Point to Survey Coordinates
code_block_25 = CodeBlock { 0; }
byCoordinates_2 = Point.ByCoordinates(x=code_block_25, y=code_block_25, z=code_block_25)
transform = Geometry.Transform(geometry=byCoordinates_2, fromCoordinateSystem=byOrigin_2, contextCoordinateSystem=rotate)
X = Point.X(point=transform)
code_block_26 = CodeBlock { 1; }
round = Math.Round(number=X, digits=code_block_26)
Y = Point.Y(point=transform)
round_2 = Math.Round(number=Y, digits=code_block_26)
Z = Point.Z(point=transform)
round_3 = Math.Round(number=Z, digits=code_block_26)
create_3 = List.Create(item0=round, item1=round_2, item2=round_3)
flatten = List.Flatten(list=create_3)

# group: Get project base point info
code_block_27 = CodeBlock { 1; }
round_4 = Math.Round(number=code_block_19.out0, digits=code_block_27)
round_5 = Math.Round(number=code_block_19.out1, digits=code_block_27)
create_4 = List.Create(item0=round_4, item1=round_5, item2=code_block_19.out2, item3=code_block_19.out3)
flatten_2 = List.Flatten(list=create_4)

# group: Gets survey coordinates of Survey Point.
categories_2 = Categories(index=432)  # graph input
all_elements_of_category_2 = ElementsOfCategory(Category=categories_2)
code_block_28 = CodeBlock { ["E/W","N/S","Elev"]; }
getParameterValueByName_4 = Element.GetParameterValueByName(element=all_elements_of_category_2, parameterName=code_block_28, lacing=Longest)
code_block_29 = CodeBlock { 1; }
round_6 = Math.Round(number=getParameterValueByName_4, digits=code_block_29, lacing=Longest)

# group: Concatenates grid letters and numbers
code_block_family_type_name = CodeBlock(var0=code_block_16.out3, var1=code_block_16.out4) { (var0)+"/"+(var1); }  # "Code Block : Family type name generator"

# group: Select Grids and extract intersection point
categories_3 = Categories(index=212)  # graph input
all_elements_of_category_3 = ElementsOfCategory(Category=categories_3)
name = Element.Name(element=all_elements_of_category_3)
eq_2 = name == code_block_16.out3
filterByBoolMask_2 = List.FilterByBoolMask(list=all_elements_of_category_3, mask=eq_2)
curve = Grid.Curve(grid=filterByBoolMask_2.in)
eq_3 = name == code_block_16.out4
filterByBoolMask_3 = List.FilterByBoolMask(list=all_elements_of_category_3, mask=eq_3)
curve_2 = Grid.Curve(grid=filterByBoolMask_3.in)
intersect = Geometry.Intersect(geometry=curve, other=curve_2, lacing=Longest)

# group: Gets grid intersection coordinates and converts to survey coodinates.
transform_2 = Geometry.Transform(geometry=intersect, fromCoordinateSystem=byOrigin_2, contextCoordinateSystem=rotate)
X_2 = Point.X(point=transform_2)
code_block_30 = CodeBlock { 1; }
Y_2 = Point.Y(point=transform_2)

flatten_3 = List.Flatten(list=X_2)

# group (continued): Gets grid intersection coordinates and converts to survey coodinates.
round_7 = Math.Round(number=flatten_3, digits=code_block_30)

flatten_4 = List.Flatten(list=Y_2)

# group (continued): Gets grid intersection coordinates and converts to survey coodinates.
round_8 = Math.Round(number=flatten_4, digits=code_block_30)

# group: Collates data lists and adds required blanks
code_block_31 = CodeBlock { "N/A"; }
model_origin = List.Create(item0=code_block_31, item1=flatten, item2=code_block_31)
code_block_32 = CodeBlock { 1; }
flatten_5 = List.Flatten(list=model_origin, amt=code_block_32)
project_base_point = List.Create(item0=code_block_31, item1=flatten_2)
flatten_6 = List.Flatten(list=project_base_point, amt=code_block_32)
survey_point = List.Create(item0=code_block_31, item1=round_6, item2=code_block_31)
flatten_7 = List.Flatten(list=survey_point, amt=code_block_32)
ref_point_a = List.Create(item0=code_block_family_type_name, item1=round_7, item2=round_8, item3=code_block_31, item4=code_block_31)
flatten_8 = List.Flatten(list=ref_point_a, amt=code_block_32)

# group: Compiles data and writes to excel file.
code_block_33 = CodeBlock { 4; }
code_block_34 = CodeBlock { 2; }
create_5 = List.Create(item0=flatten_5, item1=flatten_6, item2=flatten_7, item3=flatten_8)
exportExcel_2 = Data.ExportExcel(filePath=code_block_16.out0, sheetName=valueAtKey, startRow=code_block_33, startCol=code_block_34, data=create_5)

# group: Calculate next available row
fromPath = FileObject(path=code_block_16.out0)  # "File.FromPath"
importExcel = Data.ImportExcel(file=fromPath, sheetName=valueAtKey_2)
transpose_2 = List.Transpose(lists=importExcel)
code_block_35 = CodeBlock(x=transpose_2) { x[1]; }
boolean_3 = BoolSelector(true)  # graph input
clean = List.Clean(list=code_block_35, preserveIndices=boolean_3)
count = List.Count(list=clean)
string_from_object = FromObject()  # unwired: obj
code_block_36 = CodeBlock { 1; }
flatten_9 = List.Flatten(list=importExcel, amt=code_block_36)

# group: Current Date
today = DateTime.Today()
code_block_37 = CodeBlock { "yyyy-MM-dd"; }
format = DateTime.Format(dateTime=today, format=code_block_37)

# group: Calculate next available row
fromPath_2 = FileObject(path=code_block_16.out0)  # "File.FromPath"
importExcel_2 = Data.ImportExcel(file=fromPath_2, sheetName=valueAtKey_2)
transpose_3 = List.Transpose(lists=importExcel_2)
code_block_38 = CodeBlock(x=transpose_3) { x[1]; }
boolean_4 = BoolSelector(true)  # graph input
clean_2 = List.Clean(list=code_block_38, preserveIndices=boolean_4)
count_2 = List.Count(list=clean_2)
code_block_39 = CodeBlock { 5; }
sub = count_2 - code_block_39
code_block_40 = CodeBlock { 1; }
add_2 = sub + code_block_40
string_from_object_2 = FromObject(obj=add_2)
code_block_41 = CodeBlock { 1; }
flatten_10 = List.Flatten(list=importExcel_2, amt=code_block_41)

# group: Calculate Discipline Revision
code_block_42 = CodeBlock { "P"; }
code_block_43 = CodeBlock { 2; "0"; }
padLeft = String.PadLeft(str=string_from_object_2, newWidth=code_block_43.out0, padChars=code_block_43.out1)
add_3 = code_block_42 + padLeft

# group: Prep Record Data
create_6 = List.Create(item0=format, item1=add_3, item2=flatten, item3=flatten_2, item4=round_6, item5=flatten_8, item6=sortByKey.sorted_list)
flatten_11 = List.Flatten(list=create_6)
string_from_object_3 = FromObject(obj=flatten_11)
code_block_44 = CodeBlock { "N/A"; }
contains = String.Contains(str=string_from_object_3, searchFor=code_block_44)
filterByBoolMask_4 = List.FilterByBoolMask(list=flatten_11, mask=contains)
create_7 = List.Create(item0=filterByBoolMask_4.out)
create_8 = List.Create(item0=create_7)
transpose_4 = List.Transpose(lists=create_8)

# group: Compiles data and writes to excel file.
code_block_45 = CodeBlock { 1; }
exportExcel_3 = Data.ExportExcel(filePath=code_block_16.out0, sheetName=valueAtKey_2, startRow=count, startCol=code_block_45, data=transpose_4)

watch = Watch(code_block_family_type_name)

# group: Next available row in Audit History
code_block_46 = CodeBlock { "Revision Tracker"; }
fromPath_3 = FileObject(path=code_block_16.out0)  # "File.FromPath"
importExcel_3 = Data.ImportExcel(file=fromPath_3, sheetName=code_block_46)
transpose_5 = List.Transpose(lists=importExcel_3)
clean_3 = List.Clean(list=transpose_5)
code_block_47 = CodeBlock(x=clean_3) { x[0]; }
count_3 = List.Count(list=code_block_47)
code_block_48 = CodeBlock { 1; }
sub_2 = count_3 - code_block_48

# group: Calculate File Revision
code_block_49 = CodeBlock { "P"; }
string_from_object_4 = FromObject(obj=sub_2)
code_block_50 = CodeBlock { 2; "0"; }
padLeft_2 = String.PadLeft(str=string_from_object_4, newWidth=code_block_50.out0, padChars=code_block_50.out1)
add_4 = code_block_49 + padLeft_2

# group: Updates Revision Tracker Sheet
code_block_51 = CodeBlock { 1; }
# note: Custom Node: Rhythm v.2019.9.12
ʳʰʸᵗʰᵐ_system_currentusername = Rhythm.Helpers.System.CurrentUserName()
create_9 = List.Create(item0=ʳʰʸᵗʰᵐ_system_currentusername, item1=format, item2=add_4, item3=code_block_16.out2)
create_10 = List.Create(item0=create_9)
exportExcel_4 = Data.ExportExcel(filePath=code_block_16.out0, sheetName=code_block_46, startRow=count_3, startCol=code_block_51, data=create_10)

# group: Updates Revision to Summary Page
code_block_52 = CodeBlock { 1; }
code_block_53 = CodeBlock { 2; }
code_block_54 = CodeBlock { "Revision"; "File Revision"; }
create_11 = List.Create(item0=format, item1=code_block_54.out0, item2=add_3, item3=code_block_54.out1, item4=add_4)
create_12 = List.Create(item0=create_11)
exportExcel_5 = Data.ExportExcel(filePath=code_block_16.out0, sheetName=valueAtKey, startRow=code_block_52, startCol=code_block_53, data=create_12)

# group: Gets coordinates of Tekla Origin
categories_4 = Categories(index=212)  # graph input
all_elements_of_category_4 = ElementsOfCategory(Category=categories_4)
name_2 = Element.Name(element=all_elements_of_category_4)
eq_4 = name_2 == code_block_16.out5
filterByBoolMask_5 = List.FilterByBoolMask(list=all_elements_of_category_4, mask=eq_4)
curve_3 = Grid.Curve(grid=filterByBoolMask_5.in)
eq_5 = name_2 == code_block_16.out6
filterByBoolMask_6 = List.FilterByBoolMask(list=all_elements_of_category_4, mask=eq_5)
curve_4 = Grid.Curve(grid=filterByBoolMask_6.in)
intersect_2 = Geometry.Intersect(geometry=curve_3, other=curve_4, lacing=Longest)
flatten_12 = List.Flatten(list=intersect_2)
code_block_55 = CodeBlock { "Z"; "99"; }

# group: Set Tekla X/Y transforms to allow for rotation from Project North
toNumber = String.ToNumber(str=code_block_16.out8)
rotate_2 = CoordinateSystem.Rotate(coordinateSystem=byOrigin_2, origin=basePoint, axis=ZAxis, degrees=toNumber)
transform_3 = Geometry.Transform(geometry=flatten_12, fromCoordinateSystem=byOrigin_2, contextCoordinateSystem=rotate_2)
X_3 = Point.X(point=transform_3)
code_block_56 = CodeBlock { -1; }
mul = X_3 * code_block_56
Y_3 = Point.Y(point=transform_3)
mul_2 = Y_3 * code_block_56

# group: Tekla Revit Base Level (Z Val)
watch_2 = Watch(code_block_19.out2)
toNumber_2 = String.ToNumber(str=code_block_16.out7)
watch_3 = Watch(toNumber_2)
sub_3 = watch_2 - watch_3

tekla_revit_settings = List.Create(item0=X, item1=Y, item2=mul, item3=mul_2, item4=sub_3, item5=code_block_16.out8)
code_block_57 = CodeBlock { 1; }
flatten_13 = List.Flatten(list=tekla_revit_settings, amt=code_block_57)
code_block_58 = CodeBlock { 0.00; }

# group: Tekla Dalux Rotation
toNumber_3 = String.ToNumber(str=code_block_16.out8)
add_5 = toNumber_3 + code_block_19.out4

tekla_dalux_settings = List.Create(item0=X, item1=Y, item2=mul, item3=mul_2, item4=code_block_58, item5=add_5)
flatten_14 = List.Flatten(list=tekla_dalux_settings, amt=code_block_57)

# group: Write Tekla data to excel
code_block_59 = CodeBlock { 12; }
code_block_60 = CodeBlock { 2; }
create_13 = List.Create(item0=flatten_13, item1=flatten_14)
exportExcel_6 = Data.ExportExcel(filePath=code_block_16.out0, sheetName=valueAtKey, startRow=code_block_59, startCol=code_block_60, data=create_13)
code_block_61 = CodeBlock { 1; }
flatten_15 = List.Flatten(list=create_13, amt=code_block_61)

# group: Concatenates Tekla Origin letters and numbers
code_block_family_type_name_2 = CodeBlock(var0=code_block_16.out5, var1=code_block_16.out6) { (var0)+"/"+(var1); }  # "Code Block : Family type name generator"

watch_4 = Watch(code_block_family_type_name_2)

# group: Write Tekla Origin to excel
code_block_62 = CodeBlock { 9; }
code_block_63 = CodeBlock { 3; }
exportExcel_7 = Data.ExportExcel(filePath=code_block_16.out0, sheetName=valueAtKey, startRow=code_block_62, startCol=code_block_63, data=code_block_family_type_name_2)
