# Dynamo graph Revit and Dynamo Tutorial – Placing family instances at world coordinates.dyn (Dynamo 2.19.3.6394)

# group: Get Project Base Coords
categories = Categories("OST_ProjectBasePoint")
all_elements_of_category = ElementsOfCategory(Category=categories)
code_block = CodeBlock { "E/W"; "N/S"; "Angle to True North"; }
getParameterValueByName = Element.GetParameterValueByName(element=all_elements_of_category, parameterName=code_block.out0)
getParameterValueByName_2 = Element.GetParameterValueByName(element=all_elements_of_category, parameterName=code_block.out1)
getParameterValueByName_3 = Element.GetParameterValueByName(element=all_elements_of_category, parameterName=code_block.out2)

# group: CS Calc
easting = DoubleInput(809800000)
sub = getParameterValueByName - easting
northing = DoubleInput(819300000)
sub_2 = getParameterValueByName_2 - northing
byOrigin = CoordinateSystem.ByOrigin(x=sub, y=sub_2)
code_block_2 = CodeBlock(rot=getParameterValueByName_3) { rot-180; }

# group: Create CS at Internal Origin
identity = CoordinateSystem.Identity()
origin = CoordinateSystem.Origin(coordinateSystem=identity)
ZAxis = CoordinateSystem.ZAxis(coordinateSystem=identity)

# group: Place Family
family_types = FamilyTypes("Family (HPK24) Type E Side A:Family (HPK24) Type E Side A")
rotate = CoordinateSystem.Rotate(coordinateSystem=byOrigin, origin=origin, axis=ZAxis, degrees=code_block_2)
byCoordinateSystem = FamilyInstance.ByCoordinateSystem(familyType=family_types, coordinateSystem=rotate)
