# Dynamo graph AA_ModelChecker_Batch.dyn (Dynamo 2.18.1.5096)
# AA CWD Model Checker - rules defined in Dynamo -> XLSX report

# group: ① Settings
# Global options, output folder and a template for new rules. The template is NOT connected to All Rules.
template_enable = BoolSelector(false)
rule_template_not_connected = CodeBlock(enabled=template_enable)
# ---------- rule_template_not_connected.designscript (23 lines) ----------
// ===== NEW RULE TEMPLATE (copy this node + a Boolean, wire into All Rules) =====
// Filters: [Source, Property, Condition, Value, Operator(opt "And"/"Or"), CaseInsensitive(opt)]
//   Source   : "Parameter" | "Family" | "Type" | "Category" | "Class"
//   Condition: HasValue, HasNoValue, Equal, NotEqual, Contains, DoesNotContain,
//              BeginsWith, DoesNotBeginWith, EndsWith, DoesNotEndWith,
//              MatchesRegex, DoesNotMatchRegex, GreaterThan, LessThan, ...
// Categories: "OST_Walls" or display name "Walls"
// Mode: "Auto" | "Compliance" | "Zero" | "Info"   ElementType: "Instance" | "Type" | "Both"
rule = {
    "Heading":     "Elements Checker",
    "Section":     "My Section",
    "Name":        "My New Check",
    "Description": "Describe the check",
    "Type":        "Custom",
    "Enabled":     enabled,
    "Required":    false,
    "Mode":        "Auto",
    "ElementType": "Instance",
    "Categories":  ["OST_Doors", "OST_Windows"],
    "Filters":     [
                  ["Parameter", "Mark", "HasNoValue", ""]
                 ]
};
# ----------------------------------------
output_folder_optional = Directory("No file selected.")
global_options = CodeBlock()
# ---------- global_options.designscript (17 lines) ----------
// ===== GLOBAL OPTIONS =====
options = {
    "ReportTitle": "AAHK CWD Model Checker Rules",
    "Author": "Gavin",
    "MissingParameterCountsAsFail": true,  // HasNoValue: element without the parameter = issue
    "FamilyNameLoadableOnly": false,       // true = Family Name filters skip system families
    "ListPhaseElements": true,             // list every element on the Phase sheet
    "ShowDisabledChecks": true,            // disabled rules shown as SKIPPED
    "OpenWhenDone": true,                  // open the xlsx after export
    "MaxIdsInCell": 3000,                  // max IDs in the 'All IDs' cell
    // ---- batch mode only ----
    "DetachFromCentral": true,             // workshared: open detached, central is never touched
    "OpenAllWorksets": true,               // false = faster but elements in closed worksets are skipped
    "AuditOnOpen": false,
    "IncludeSubfolders": false,            // folder input: also search sub folders
    "SkipBackupFiles": true                // skip *.0001.rvt backups
};
# ----------------------------------------

# group: ② Rules - Elements Checker
# Toggle = enable/disable the rule. Edit the Code Block to change the rule.
enable_cat_code_ts_parameters = BoolSelector(true)
rules_cat_code_ts_parameters_28 = CodeBlock(enabled=enable_cat_code_ts_parameters)
# ---------- rules_cat_code_ts_parameters_28.designscript (54 lines) ----------
// ===== CAT Code + Asset / TS Parameters (batch) =====
// One rule per parameter: elements with an empty / missing parameter are listed as issues
// Edit the params list to add or remove parameters. Output 'rules' -> All Rules
def mkRule(p : string, cats : var[]..[], en : bool)
{
    return {
        "Heading":     "Elements Checker",
        "Section":     "Parameter Input",
        "Name":        p,
        "Description": "To check whether all elements have " + p + " input",
        "Type":        "Custom",
        "Enabled":     en,
        "Required":    false,
        "Mode":        "Auto",
        "ElementType": "Instance",
        "Categories":  cats,
        "Filters":     [["Parameter", p, "HasNoValue", ""]]
    };
}

params = [
    "CAT Code", "NQAA", "TS_ASS", "TS_ASS_L1", "TS_ASS_L2",
    "TS_ASS_L3", "TS_ASS_L4", "TS_DWN", "TS_FDES", "TS_FFA",
    "TS_FIN", "TS_FLC", "TS_ICWO", "TS_INS", "TS_IWC",
    "TS_LOC", "TS_LOC_L1", "TS_LOC_L2", "TS_LOC_L3", "TS_LOC_L4",
    "TS_MFG", "TS_MMN", "TS_MSN", "TS_QTY", "TS_SRN",
    "TS_ULF", "TS_UOM", "TS_WED"
];

cats = [
    "OST_Casework", "OST_Ceilings", "OST_Columns",
    "OST_CurtainWallPanels", "OST_CurtainWallMullions", "OST_Doors",
    "OST_ElectricalEquipment", "OST_ElectricalFixtures", "OST_Floors",
    "OST_Furniture", "OST_GenericModel", "OST_LightingFixtures",
    "OST_Mass", "OST_MechanicalEquipment", "OST_Parking",
    "OST_Parts", "OST_Planting", "OST_PlumbingFixtures",
    "OST_StairsRailing", "OST_Ramps", "OST_Roads",
    "OST_Roofs", "OST_Site", "OST_SpecialityEquipment",
    "OST_Stairs", "OST_StructuralColumns", "OST_StructConnections",
    "OST_StructuralFoundation", "OST_StructuralFraming", "OST_Rebar",
    "OST_StructuralStiffener", "OST_Topography", "OST_Walls",
    "OST_Windows", "OST_ShaftOpening", "OST_StructuralTruss",
    "OST_DuctTerminal", "OST_CableTrayFitting", "OST_CableTray",
    "OST_CommunicationDevices", "OST_ConduitFitting", "OST_ConduitRun",
    "OST_Conduit", "OST_DataDevices", "OST_DuctAccessory",
    "OST_DuctFitting", "OST_DuctInsulations", "OST_PlaceHolderDucts",
    "OST_DuctCurves", "OST_FireAlarmDevices", "OST_FlexDuctCurves",
    "OST_FlexPipeCurves", "OST_LightingDevices", "OST_PipeAccessory",
    "OST_PipeFitting", "OST_PipeInsulations", "OST_PlaceHolderPipes",
    "OST_PipeCurves", "OST_SecurityDevices", "OST_Sprinklers",
    "OST_TelephoneDevices"
];

rules = mkRule(params, cats, enabled);
# ----------------------------------------
enable_room_list = BoolSelector(true)
rule_room_list = CodeBlock(enabled=enable_room_list)
# ---------- rule_room_list.designscript (17 lines) ----------
// ===== Room List =====
// Enabled is driven by the Boolean toggle on the left
rule = {
    "Heading":     "Elements Checker",
    "Section":     "Family",
    "Name":        "Room List",
    "Description": "List the rooms in the model",
    "Type":        "Custom",
    "Enabled":     enabled,
    "Required":    true,
    "Mode":        "Auto",
    "ElementType": "Instance",
    "Categories":  [
                  "OST_Rooms"
                 ],
    "Filters":     []
};
# ----------------------------------------
enable_generic_model = BoolSelector(true)
rule_generic_model = CodeBlock(enabled=enable_generic_model)
# ---------- rule_generic_model.designscript (17 lines) ----------
// ===== Generic Model =====
// Enabled is driven by the Boolean toggle on the left
rule = {
    "Heading":     "Elements Checker",
    "Section":     "Family",
    "Name":        "Generic Model",
    "Description": "Check and list all generic models",
    "Type":        "Custom",
    "Enabled":     enabled,
    "Required":    false,
    "Mode":        "Auto",
    "ElementType": "Instance",
    "Categories":  [
                  "OST_GenericModel"
                 ],
    "Filters":     []
};
# ----------------------------------------
enable_family_name = BoolSelector(true)
rule_family_name = CodeBlock(enabled=enable_family_name)
# ---------- rule_family_name.designscript (30 lines) ----------
// ===== Family Name =====
// Enabled is driven by the Boolean toggle on the left
rule = {
    "Heading":     "Elements Checker",
    "Section":     "Family",
    "Name":        "Family Name",
    "Description": "To check whether all family names have started with 'AA-'",
    "Type":        "Custom",
    "Enabled":     enabled,
    "Required":    false,
    "Mode":        "Auto",
    "ElementType": "Instance",
    "Categories":  [
                  "OST_Casework", "OST_Ceilings", "OST_Columns",
                  "OST_CurtainWallPanels", "OST_CurtaSystem", "OST_CurtainWallMullions",
                  "OST_Doors", "OST_ElectricalEquipment", "OST_ElectricalFixtures",
                  "OST_Floors", "OST_Furniture", "OST_GenericModel",
                  "OST_LightingFixtures", "OST_MechanicalEquipment", "OST_Parking",
                  "OST_Parts", "OST_Planting", "OST_PlumbingFixtures",
                  "OST_StairsRailing", "OST_Ramps", "OST_Roads",
                  "OST_Roofs", "OST_Site", "OST_SpecialityEquipment",
                  "OST_Stairs", "OST_StructuralFramingSystem", "OST_StructuralColumns",
                  "OST_StructConnections", "OST_StructuralFoundation", "OST_StructuralFraming",
                  "OST_Rebar", "OST_StructuralStiffener", "OST_Topography",
                  "OST_Walls", "OST_Windows"
                 ],
    "Filters":     [
                  ["Family", "Name", "DoesNotContain", "AA-"]
                 ]
};
# ----------------------------------------
enable_in_place_families = BoolSelector(true)
rule_in_place_families = CodeBlock(enabled=enable_in_place_families)
# ---------- rule_in_place_families.designscript (17 lines) ----------
// ===== In-Place Families =====
// Enabled is driven by the Boolean toggle on the left
rule = {
    "Heading":     "Elements Checker",
    "Section":     "Family",
    "Name":        "In-Place Families",
    "Description": "Check if any In-Place Families exist in the model.",
    "Type":        "Custom",
    "Enabled":     enabled,
    "Required":    false,
    "Mode":        "Zero",
    "ElementType": "Instance",
    "Categories":  [],
    "Filters":     [
                  ["Family", "Is In Place", "Equal", "True"]
                 ]
};
# ----------------------------------------
enable_mass_elements = BoolSelector(true)
rule_mass_elements = CodeBlock(enabled=enable_mass_elements)
# ---------- rule_mass_elements.designscript (17 lines) ----------
// ===== Mass Elements =====
// Enabled is driven by the Boolean toggle on the left
rule = {
    "Heading":     "Elements Checker",
    "Section":     "Family",
    "Name":        "Mass Elements",
    "Description": "Check if any Mass Elements have been placed in the model.",
    "Type":        "Custom",
    "Enabled":     enabled,
    "Required":    false,
    "Mode":        "Zero",
    "ElementType": "Instance",
    "Categories":  [
                  "OST_Mass"
                 ],
    "Filters":     []
};
# ----------------------------------------
enable_phase_elements = BoolSelector(true)
rule_phase_elements = CodeBlock(enabled=enable_phase_elements)
# ---------- rule_phase_elements.designscript (12 lines) ----------
// ===== Phase Elements =====
// Enabled is driven by the Boolean toggle on the left
rule = {
    "Heading":     "Elements Checker",
    "Section":     "Phasing",
    "Name":        "Phase Elements",
    "Description": "Will list the number of elements created on each phase of the project.",
    "Type":        "PhaseElements",
    "Enabled":     enabled,
    "Required":    false,
    "Mode":        "Auto"
};
# ----------------------------------------

# group: ② Rules - <--Unused-->
# Toggle = enable/disable the rule. Edit the Code Block to change the rule.
enable_views_with_hidden_model = BoolSelector(false)  # "Enable - Views With Hidden Model Elements"
rule_views_with_hidden_model = CodeBlock(enabled=enable_views_with_hidden_model)  # "Rule - Views With Hidden Model Elements"
# ---------- rule_views_with_hidden_model.designscript (12 lines) ----------
// ===== Views With Hidden Model Elements =====
// Enabled is driven by the Boolean toggle on the left
rule = {
    "Heading":     "<--Unused-->",
    "Section":     "<--Unused-->",
    "Name":        "Views With Hidden Model Elements",
    "Description": "Lists all views in a Revit model that have permanently hidden model elements and the total number of hidden elements.",
    "Type":        "ViewsWithHiddenElements",
    "Enabled":     enabled,
    "Required":    false,
    "Mode":        "Auto"
};
# ----------------------------------------
enable_largest_families = BoolSelector(false)
rule_largest_families = CodeBlock(enabled=enable_largest_families)
# ---------- rule_largest_families.designscript (12 lines) ----------
// ===== Largest Families =====
// Enabled is driven by the Boolean toggle on the left
rule = {
    "Heading":     "<--Unused-->",
    "Section":     "<--Unused-->",
    "Name":        "Largest Families",
    "Description": "Will report the families in the project ordered by file size.",
    "Type":        "TenLargestFamilies",
    "Enabled":     enabled,
    "Required":    false,
    "Mode":        "Auto"
};
# ----------------------------------------
enable_file_size = BoolSelector(false)
rule_file_size = CodeBlock(enabled=enable_file_size)
# ---------- rule_file_size.designscript (12 lines) ----------
// ===== File Size =====
// Enabled is driven by the Boolean toggle on the left
rule = {
    "Heading":     "<--Unused-->",
    "Section":     "<--Unused-->",
    "Name":        "File Size",
    "Description": "Reports the file size of a Revit model in MB (megabytes).",
    "Type":        "FileSize",
    "Enabled":     enabled,
    "Required":    false,
    "Mode":        "Auto"
};
# ----------------------------------------
enable_link_type = BoolSelector(false)
rule_link_type = CodeBlock(enabled=enable_link_type)
# ---------- rule_link_type.designscript (17 lines) ----------
// ===== Link Type =====
// Enabled is driven by the Boolean toggle on the left
rule = {
    "Heading":     "<--Unused-->",
    "Section":     "<--Unused-->",
    "Name":        "Link Type",
    "Description": "",
    "Type":        "Custom",
    "Enabled":     enabled,
    "Required":    false,
    "Mode":        "Zero",
    "ElementType": "Both",
    "Categories":  [],
    "Filters":     [
                  ["Parameter", "Path Type", "Equal", "Relative"]
                 ]
};
# ----------------------------------------

# group: ② Rules - Model File Checker
# Toggle = enable/disable the rule. Edit the Code Block to change the rule.
enable_project_coordinates = BoolSelector(true)
rule_project_coordinates = CodeBlock(enabled=enable_project_coordinates)
# ---------- rule_project_coordinates.designscript (12 lines) ----------
// ===== Project Coordinates =====
// Enabled is driven by the Boolean toggle on the left
rule = {
    "Heading":     "Model File Checker",
    "Section":     "Model Setting",
    "Name":        "Project Coordinates",
    "Description": "Will report the coordinates of the survey and project base points, elevation, and true north.",
    "Type":        "ProjectCoordinates",
    "Enabled":     enabled,
    "Required":    false,
    "Mode":        "Auto"
};
# ----------------------------------------
enable_project_information = BoolSelector(true)
rule_project_information = CodeBlock(enabled=enable_project_information)
# ---------- rule_project_information.designscript (12 lines) ----------
// ===== Project Information =====
// Enabled is driven by the Boolean toggle on the left
rule = {
    "Heading":     "Model File Checker",
    "Section":     "Model Setting",
    "Name":        "Project Information",
    "Description": "Lists all parameters and values attached to Project Information for a project except those associated with Revit Extensions (starting with 'Extensions').",
    "Type":        "ProjectInformation",
    "Enabled":     enabled,
    "Required":    false,
    "Mode":        "Auto"
};
# ----------------------------------------

# group: ② Rules - Housekeeping
# Toggle = enable/disable the rule. Edit the Code Block to change the rule.
enable_linked_cad = BoolSelector(true)
rule_linked_cad = CodeBlock(enabled=enable_linked_cad)
# ---------- rule_linked_cad.designscript (12 lines) ----------
// ===== Linked CAD =====
// Enabled is driven by the Boolean toggle on the left
rule = {
    "Heading":     "Housekeeping",
    "Section":     "Unpurged Elements and References",
    "Name":        "Linked CAD",
    "Description": "Will report a list of linked CAD files in the model.",
    "Type":        "LinkedCad",
    "Enabled":     enabled,
    "Required":    false,
    "Mode":        "Auto"
};
# ----------------------------------------
enable_link_method = BoolSelector(true)
rule_link_method = CodeBlock(enabled=enable_link_method)
# ---------- rule_link_method.designscript (12 lines) ----------
// ===== Link Method =====
// Enabled is driven by the Boolean toggle on the left
rule = {
    "Heading":     "Housekeeping",
    "Section":     "Unpurged Elements and References",
    "Name":        "Link Method",
    "Description": "Will report the link method (overlay vs. attach) for each link in the model.",
    "Type":        "LinkMethod",
    "Enabled":     enabled,
    "Required":    false,
    "Mode":        "Auto"
};
# ----------------------------------------
enable_raster_images = BoolSelector(true)
rule_raster_images = CodeBlock(enabled=enable_raster_images)
# ---------- rule_raster_images.designscript (12 lines) ----------
// ===== Raster Images =====
// Enabled is driven by the Boolean toggle on the left
rule = {
    "Heading":     "Housekeeping",
    "Section":     "Unpurged Elements and References",
    "Name":        "Raster Images",
    "Description": "Lists all raster images in a Revit model.",
    "Type":        "RasterImages",
    "Enabled":     enabled,
    "Required":    false,
    "Mode":        "Auto"
};
# ----------------------------------------
enable_unused_elements = BoolSelector(true)
rule_unused_elements = CodeBlock(enabled=enable_unused_elements)
# ---------- rule_unused_elements.designscript (12 lines) ----------
// ===== Unused Elements =====
// Enabled is driven by the Boolean toggle on the left
rule = {
    "Heading":     "Housekeeping",
    "Section":     "Unpurged Elements and References",
    "Name":        "Unused Elements",
    "Description": "Reports the number of elements that can be purged from a Revit model.",
    "Type":        "UnusedElements",
    "Enabled":     enabled,
    "Required":    false,
    "Mode":        "Auto"
};
# ----------------------------------------
enable_imported_skp = BoolSelector(true)
rule_imported_skp = CodeBlock(enabled=enable_imported_skp)
# ---------- rule_imported_skp.designscript (12 lines) ----------
// ===== Imported SKP =====
// Enabled is driven by the Boolean toggle on the left
rule = {
    "Heading":     "Housekeeping",
    "Section":     "Unpurged Elements and References",
    "Name":        "Imported SKP",
    "Description": "Will report the number of imported SKP files.",
    "Type":        "ImportedSkp",
    "Enabled":     enabled,
    "Required":    false,
    "Mode":        "Auto"
};
# ----------------------------------------
enable_worksets = BoolSelector(true)
rule_worksets = CodeBlock(enabled=enable_worksets)
# ---------- rule_worksets.designscript (12 lines) ----------
// ===== Worksets =====
// Enabled is driven by the Boolean toggle on the left
rule = {
    "Heading":     "Housekeeping",
    "Section":     "Unpurged Elements and References",
    "Name":        "Worksets",
    "Description": "Lists all user worksets for a Revit model or reports '*Not Workshared*' if worksharing is not enabled.  Also optionally lists the number of instances in each workset.",
    "Type":        "Worksets",
    "Enabled":     enabled,
    "Required":    false,
    "Mode":        "Auto"
};
# ----------------------------------------
enable_design_options = BoolSelector(true)
rule_design_options = CodeBlock(enabled=enable_design_options)
# ---------- rule_design_options.designscript (12 lines) ----------
// ===== Design Options =====
// Enabled is driven by the Boolean toggle on the left
rule = {
    "Heading":     "Housekeeping",
    "Section":     "Unpurged Elements and References",
    "Name":        "Design Options",
    "Description": "Lists all Design Options in a Revit model.  Also optionally lists the number of instances in each design option.",
    "Type":        "DesignOptions",
    "Enabled":     enabled,
    "Required":    false,
    "Mode":        "Auto"
};
# ----------------------------------------
enable_warning_count = BoolSelector(true)
rule_warning_count = CodeBlock(enabled=enable_warning_count)
# ---------- rule_warning_count.designscript (12 lines) ----------
// ===== Warning Count =====
// Enabled is driven by the Boolean toggle on the left
rule = {
    "Heading":     "Housekeeping",
    "Section":     "Warning",
    "Name":        "Warning Count",
    "Description": "Reports all warnings in a Revit model.",
    "Type":        "WarningCount",
    "Enabled":     enabled,
    "Required":    false,
    "Mode":        "Auto"
};
# ----------------------------------------

# group: ④ Batch - RVT files (background)
# Batch Mode = True: each file is opened in the background, checked and closed without saving. One xlsx per file.
batch_mode_false_current_model = BoolSelector(false)
rvt_files_folders = CodeBlock(batch=batch_mode_false_current_model)
# ---------- rvt_files_folders.designscript (11 lines) ----------
// ===== BATCH: RVT FILES =====
// batch = false -> check the CURRENT model only
// batch = true  -> open every file below in the BACKGROUND, check, close WITHOUT saving
//                  one xlsx per file (written to Output Folder, or next to each rvt)
// Items can be .rvt file paths and/or folder paths (all .rvt in the folder)
// Use / or \\ in paths, e.g. "D:/Project/Models"
files = [
    "C:/Models/Project_A.rvt",
    "C:/Models/Batch Folder"
];
rvt = batch ? files : null;
# ----------------------------------------

# group: ③ Run
# All Rules collects every rule (use + to add inputs). OUT = single: [xlsx, summary, messages] / batch: [xlsx list, batch table, messages].
all_rules = List.Create(item0=rules_cat_code_ts_parameters_28.out2, item1=rule_room_list, item2=rule_generic_model, item3=rule_family_name, item4=rule_in_place_families, item5=rule_mass_elements, item6=rule_phase_elements, item7=rule_views_with_hidden_model, item8=rule_largest_families, item9=rule_file_size, item10=rule_link_type, item11=rule_project_coordinates, item12=rule_project_information, item13=rule_linked_cad, item14=rule_link_method, item15=rule_raster_images, item16=rule_unused_elements, item17=rule_imported_skp, item18=rule_worksets, item19=rule_design_options, item20=rule_warning_count)
aa_model_checker_rules_in_dynamo = Python(IN[0]=all_rules, IN[1]=output_folder_optional, IN[2]=global_options, IN[3]=rvt_files_folders.rvt)  # CPython3
# ---------- aa_model_checker_rules_in_dynamo.python (1795 lines) ----------
# -*- coding: utf-8 -*-
"""
AA CWD Model Checker for Dynamo (Revit)  -  CPython3 / PythonNet3   [Rules-in-Dynamo edition]
-------------------------------------------------------------------------------------------
Rules are defined directly in the Dynamo graph (Code Blocks) instead of a checkset XML.
Writes an .xlsx:
  * "Summary"        : completion %, status of every check, completion by category
  * one sheet / check: related elements with Element ID / Unique ID (GUID) / IFC GUID
  * "Rule Settings"  : the exact rules used for this run (audit trail)

Inputs
  IN[0] : rules   - list (can be nested) of rule dictionaries from the Code Blocks
  IN[1] : output folder or full .xlsx path  (optional)
  IN[2] : global options dictionary         (optional)
  IN[3] : RVT files to check in BATCH mode   (optional)
          - list of .rvt paths, and/or folder path(s) (all .rvt inside are used)
          - empty / null -> check the current open model only (single mode)
          Files are opened in the BACKGROUND (not shown in Revit UI), checked, then
          closed WITHOUT saving. One xlsx is created per file.
Output
  single: [xlsx path, summary table, rule validation messages]
  batch : [list of xlsx paths, batch summary table, messages]

RULE DICTIONARY KEYS
  "Name" (required), "Heading", "Section", "Description",
  "Type"        : "Custom" or prebuilt (PhaseElements, ProjectCoordinates, ProjectInformation,
                  LinkedCad, LinkMethod, RasterImages, UnusedElements, ImportedSkp, Worksets,
                  DesignOptions, WarningCount, ViewsWithHiddenElements, FileSize, TenLargestFamilies)
  "Enabled"     : true / false
  "Required"    : true / false  (info check FAILs when nothing found)
  "Mode"        : "Auto" | "Compliance" | "Zero" | "Info"
  "Categories"  : list of "OST_Walls" / "Walls" / Dynamo Category objects
  "ElementType" : "Instance" | "Type" | "Both"
  "Filters"     : [[Source, Property, Condition, Value, Operator(opt), CaseInsensitive(opt)], ...]
                  Source: Parameter | Family | Type | Category | Class
                  Condition: HasValue, HasNoValue, Exists, DoesNotExist, Equal, NotEqual, Contains,
                  DoesNotContain, BeginsWith, DoesNotBeginWith, EndsWith, DoesNotEndWith,
                  MatchesRegex, DoesNotMatchRegex, GreaterThan(OrEqual), LessThan(OrEqual)
                  A filter MATCH = the element is reported as an issue / found item.
"""
import clr
import os
import re
import datetime
import zipfile
import traceback

clr.AddReference('RevitAPI')
import Autodesk.Revit.DB as DB
clr.AddReference('RevitServices')
from RevitServices.Persistence import DocumentManager
from RevitServices.Transactions import TransactionManager
clr.AddReference('System')
import System
from System.Collections.Generic import List, HashSet

doc = DocumentManager.Instance.CurrentDBDocument

# =====================================================================
# GLOBAL OPTIONS  (defaults - overridden by the "Global Options" node, IN[2])
# =====================================================================
REPORT_TITLE = "AAHK CWD Model Checker Rules"
REPORT_AUTHOR = ""
MISSING_PARAMETER_COUNTS_AS_FAIL = True
FAMILY_NAME_LOADABLE_ONLY = False
LIST_PHASE_ELEMENTS = True
SHOW_DISABLED_CHECKS = True
OPEN_WHEN_DONE = True
MAX_IDS_IN_CELL = 3000
# ---- batch options ----
DETACH_FROM_CENTRAL = True                  # workshared files: open detached (preserve worksets)
OPEN_ALL_WORKSETS = True                    # False = close all worksets (faster, but elements hidden)
AUDIT_ON_OPEN = False                       # run Audit when opening
INCLUDE_SUBFOLDERS = False                  # folder input: search sub folders
SKIP_BACKUP_FILES = True                    # skip *.0001.rvt backup files

OPTION_KEYS = {
    "reporttitle": "REPORT_TITLE",
    "author": "REPORT_AUTHOR",
    "missingparametercountsasfail": "MISSING_PARAMETER_COUNTS_AS_FAIL",
    "familynameloadableonly": "FAMILY_NAME_LOADABLE_ONLY",
    "listphaseelements": "LIST_PHASE_ELEMENTS",
    "showdisabledchecks": "SHOW_DISABLED_CHECKS",
    "openwhendone": "OPEN_WHEN_DONE",
    "maxidsincell": "MAX_IDS_IN_CELL",
    "detachfromcentral": "DETACH_FROM_CENTRAL",
    "openallworksets": "OPEN_ALL_WORKSETS",
    "auditonopen": "AUDIT_ON_OPEN",
    "includesubfolders": "INCLUDE_SUBFOLDERS",
    "skipbackupfiles": "SKIP_BACKUP_FILES",
}

# =====================================================================
# GENERIC HELPERS
# =====================================================================
FT_TO_MM = 304.8
SQFT_TO_SQM = 0.09290304


def idval(eid):
    try:
        return int(eid.Value)            # Revit 2024+
    except Exception:
        try:
            return int(eid.IntegerValue)  # Revit <= 2023
        except Exception:
            return -1


def safe(func, default=""):
    try:
        v = func()
        return default if v is None else v
    except Exception:
        return default


def bip(name):
    return getattr(DB.BuiltInParameter, name, None)


def elem_name(e):
    if e is None:
        return ""
    try:
        n = e.Name
        if n is not None:
            return n
    except Exception:
        pass
    try:
        return DB.Element.Name.GetValue(e)
    except Exception:
        return ""


def param_str(p):
    if p is None:
        return None
    try:
        st = p.StorageType
        if st == DB.StorageType.String:
            return p.AsString()
        v = p.AsValueString()
        if v is not None:
            return v
        if st == DB.StorageType.Integer:
            return str(p.AsInteger())
        if st == DB.StorageType.Double:
            return str(p.AsDouble())
        if st == DB.StorageType.ElementId:
            i = idval(p.AsElementId())
            return "" if i < 0 else str(i)
    except Exception:
        return None
    return None


_type_cache = {}


def get_type(e):
    try:
        if isinstance(e, DB.ElementType):
            return None
        tid = e.GetTypeId()
        k = idval(tid)
        if k <= 0:
            return None
        if k not in _type_cache:
            _type_cache[k] = doc.GetElement(tid)
        return _type_cache[k]
    except Exception:
        return None


def param_lookup(e, name):
    """returns (exists, first non-empty value) looking at instance then type"""
    exists = False
    first = None
    targets = [e]
    t = get_type(e)
    if t is not None:
        targets.append(t)
    for el in targets:
        p = safe(lambda: el.LookupParameter(name), None)
        if p is None:
            continue
        exists = True
        v = param_str(p)
        if v is not None and str(v).strip() != "":
            return True, v
        if first is None:
            first = v
    return exists, first


def family_info(e):
    """(family name, is in place, is loadable)"""
    try:
        if isinstance(e, DB.FamilyInstance):
            f = e.Symbol.Family
            return f.Name, bool(f.IsInPlace), True
        t = e if isinstance(e, DB.ElementType) else get_type(e)
        if isinstance(t, DB.FamilySymbol):
            f = t.Family
            return f.Name, bool(f.IsInPlace), True
        if t is not None:
            return safe(lambda: t.FamilyName), False, False
    except Exception:
        pass
    return "", False, False


_name_cache = {}


def name_of(eid):
    k = idval(eid)
    if k <= 0:
        return ""
    if k not in _name_cache:
        _name_cache[k] = elem_name(doc.GetElement(eid))
    return _name_cache[k]


LEVEL_BIPS = [b for b in [bip(n) for n in (
    "FAMILY_LEVEL_PARAM", "INSTANCE_REFERENCE_LEVEL_PARAM", "SCHEDULE_LEVEL_PARAM",
    "RBS_START_LEVEL_PARAM", "STAIRS_BASE_LEVEL_PARAM", "WALL_BASE_CONSTRAINT",
    "LEVEL_PARAM", "ROOF_BASE_LEVEL_PARAM", "FAMILY_BASE_LEVEL_PARAM")] if b is not None]


def level_name(e):
    lid = safe(lambda: e.LevelId, None)
    if lid is not None and idval(lid) > 0:
        return name_of(lid)
    for b in LEVEL_BIPS:
        p = safe(lambda: e.get_Parameter(b), None)
        if p is not None and p.StorageType == DB.StorageType.ElementId:
            i = p.AsElementId()
            if idval(i) > 0:
                return name_of(i)
    return ""


_ws_cache = {}


def workset_name(e):
    if not doc.IsWorkshared:
        return ""
    try:
        wid = e.WorksetId
        k = wid.IntegerValue
        if k not in _ws_cache:
            _ws_cache[k] = doc.GetWorksetTable().GetWorkset(wid).Name
        return _ws_cache[k]
    except Exception:
        return ""


IFC_CHARS = "0123456789ABCDEFGHIJKLMNOPQRSTUVWXYZabcdefghijklmnopqrstuvwxyz_$"


def guid_to_ifc(g):
    n = int(str(g).replace("-", "").replace("{", "").replace("}", ""), 16)
    out = []
    for _ in range(22):
        out.append(IFC_CHARS[n % 64])
        n //= 64
    return "".join(reversed(out))


def ifc_guid(e):
    for n in ("IFC_GUID", "IFC_TYPE_GUID"):
        b = bip(n)
        if b is None:
            continue
        p = safe(lambda: e.get_Parameter(b), None)
        v = param_str(p) if p is not None else None
        if v:
            return v
    try:
        return guid_to_ifc(DB.ExportUtils.GetExportId(doc, e.Id))
    except Exception:
        return ""


def cat_name(e):
    return safe(lambda: e.Category.Name)


def bic_name(e):
    try:
        return str(System.Enum.ToObject(DB.BuiltInCategory, idval(e.Category.Id)))
    except Exception:
        return ""


COMMON_HEADERS = ["Element ID", "Unique ID (GUID)", "IFC GUID", "Category", "Family", "Type",
                  "Name", "Level", "Workset", "Phase Created", "Mark"]


def common_row(e):
    t = get_type(e)
    fam = family_info(e)[0]
    if isinstance(e, DB.ElementType):
        tname = elem_name(e)
    else:
        tname = elem_name(t) if t is not None else ""
    mark = ""
    b = bip("ALL_MODEL_MARK")
    if b is not None:
        mark = param_str(safe(lambda: e.get_Parameter(b), None)) or ""
    phase = ""
    try:
        phase = name_of(e.CreatedPhaseId)
    except Exception:
        pass
    return [idval(e.Id), safe(lambda: e.UniqueId), ifc_guid(e), cat_name(e), fam, tname,
            elem_name(e), level_name(e), workset_name(e), phase, mark]


def fec():
    return DB.FilteredElementCollector(doc)


def all_elements_collector():
    return fec().WherePasses(DB.LogicalOrFilter(DB.ElementIsElementTypeFilter(False),
                                                DB.ElementIsElementTypeFilter(True)))


def yn(b):
    return "Yes" if b else "No"


def new_result(mode, headers):
    return {"mode": mode, "headers": headers, "rows": [], "info": [], "checked": None,
            "failed": 0, "found": 0, "note": "", "by_cat": {}, "ids": []}


# =====================================================================
# CUSTOM (FILTER BASED) CHECKS
# =====================================================================
NUM_RE = re.compile(r"[-+]?\d*\.?\d+(?:[eE][-+]?\d+)?")


def _num(s):
    m = NUM_RE.search(str(s))
    return float(m.group(0)) if m else None


def compare(exists, v, cond, target, ci):
    c = (cond or "").lower()
    if c == "hasnovalue":
        if not exists:
            return MISSING_PARAMETER_COUNTS_AS_FAIL
        return v is None or str(v).strip() == ""
    if c == "hasvalue":
        return exists and v is not None and str(v).strip() != ""
    if c in ("exists", "defined"):
        return exists
    if c in ("doesnotexist", "notexists", "undefined"):
        return not exists
    if not exists:
        return False
    if isinstance(v, bool):
        sv = "true" if v else "false"
        st = str(target).lower()
    else:
        sv = "" if v is None else str(v)
        st = "" if target is None else str(target)
        if ci:
            sv, st = sv.lower(), st.lower()
    if c in ("equal", "equals", "isequalto"):
        return sv == st
    if c in ("notequal", "doesnotequal", "notequals"):
        return sv != st
    if c == "contains":
        return st in sv
    if c in ("doesnotcontain", "notcontains"):
        return st not in sv
    if c in ("beginswith", "startswith"):
        return sv.startswith(st)
    if c in ("doesnotbeginwith", "doesnotstartwith"):
        return not sv.startswith(st)
    if c == "endswith":
        return sv.endswith(st)
    if c == "doesnotendwith":
        return not sv.endswith(st)
    if c in ("matchesregex", "regex", "wildcard"):
        return re.search(str(target), sv, re.I if ci else 0) is not None
    if c in ("doesnotmatchregex", "notregex", "wildcardnomatch"):
        return re.search(str(target), sv, re.I if ci else 0) is None
    if c in ("greaterthan", "greaterthanorequal", "lessthan", "lessthanorequal"):
        a, b = _num(sv), _num(st)
        if a is None or b is None:
            return False
        return {"greaterthan": a > b, "greaterthanorequal": a >= b,
                "lessthan": a < b, "lessthanorequal": a <= b}[c]
    raise ValueError("Unsupported condition: " + str(cond))


# =====================================================================
# CUSTOM (FILTER BASED) CHECKS
# =====================================================================
def eval_filter(e, f):
    src, prop, cond, val, ci = f["src"], f["prop"], f["cond"], f["val"], f["ci"]
    s = src.lower()
    if s == "parameter":
        exists, v = param_lookup(e, prop)
        m = compare(exists, v, cond, val, ci)
        if not exists:
            d = "Parameter '%s' not found" % prop
        elif v is None or str(v).strip() == "":
            d = "'%s' is empty" % prop
        else:
            d = "%s = %s" % (prop, v)
        return m, d
    if s == "family":
        name, inplace, loadable = family_info(e)
        p = prop.lower().replace(" ", "")
        if p == "name":
            if FAMILY_NAME_LOADABLE_ONLY and not loadable:
                return False, ""
            return compare(True, name, cond, val, ci), "Family = '%s' (%s '%s')" % (name, cond, val)
        if p == "isinplace":
            return compare(True, inplace, cond, val, ci), "In-Place family: %s" % name
        raise ValueError("Unsupported Family property: " + str(prop))
    if s == "type":
        t = e if isinstance(e, DB.ElementType) else get_type(e)
        tn = elem_name(t) if t is not None else ""
        if prop.lower() == "name":
            return compare(t is not None, tn, cond, val, ci), "Type = '%s'" % tn
        raise ValueError("Unsupported Type property: " + str(prop))
    if s == "category":
        cn = cat_name(e)
        if prop.lower() == "name":
            return compare(True, cn, cond, val, ci), "Category = '%s'" % cn
        m = (bic_name(e) == prop)
        if cond.lower() == "excluded":
            m = not m
        return m, ""
    if s in ("class", "apiclass", "apitype"):
        cls = e.GetType().Name
        return compare(True, cls, cond, val, ci), "Class = %s" % cls
    raise ValueError("Unsupported filter source: %s / %s" % (src, prop))


_cat_by_name = None


def _category_name_map():
    global _cat_by_name
    if _cat_by_name is None:
        _cat_by_name = {}
        for c in doc.Settings.Categories:
            try:
                _cat_by_name[c.Name.lower()] = idval(c.Id)
            except Exception:
                pass
    return _cat_by_name


def resolve_category(c):
    """returns (BuiltInCategory or None, label)"""
    if c is None:
        return None, ""
    if isinstance(c, str):
        s = c.strip()
        if not s:
            return None, ""
        if s.upper().startswith("OST_"):
            b = getattr(DB.BuiltInCategory, s, None)
            if b is None:
                for n in System.Enum.GetNames(DB.BuiltInCategory):
                    if n.lower() == s.lower():
                        b = getattr(DB.BuiltInCategory, n)
                        break
            return b, s
        i = _category_name_map().get(s.lower())
        if i is not None and i < 0:
            return System.Enum.ToObject(DB.BuiltInCategory, i), s
        return None, s
    try:
        if isinstance(c, DB.BuiltInCategory):
            return c, str(c)
    except Exception:
        pass
    try:
        i = c.Id
        i = idval(i) if not isinstance(i, int) else i
        if i < 0:
            return System.Enum.ToObject(DB.BuiltInCategory, i), safe(lambda: c.Name, str(i))
    except Exception:
        pass
    return None, str(c)


def run_custom(chk):
    cats = chk["categories"]
    criteria = chk["filters"]
    et = chk["element_type"]
    mode = chk["mode"]
    if mode == "auto":
        mode = "compliance" if (criteria and cats) else ("zero" if criteria else "info")

    bics, bad, labels = [], [], []
    for c in cats:
        b, lab = resolve_category(c)
        if b is None:
            bad.append(lab)
        elif b not in bics:
            bics.append(b)
            labels.append(str(b))
    col = fec()
    if cats:
        if not bics:
            r = new_result(mode, COMMON_HEADERS)
            r["note"] = "None of the categories could be resolved in this model / Revit version: " + ", ".join(bad)
            r["checked"] = 0
            return r
        col = col.WherePasses(DB.ElementMulticategoryFilter(List[DB.BuiltInCategory](bics)))
    if et == "type":
        col = col.WhereElementIsElementType()
    elif et == "instance":
        col = col.WhereElementIsNotElementType()
    else:
        col = col.WherePasses(DB.LogicalOrFilter(DB.ElementIsElementTypeFilter(False),
                                                 DB.ElementIsElementTypeFilter(True)))
    population = [e for e in col if e is not None]
    if cats:
        population = [e for e in population if e.Category is not None]

    rooms_only = set(labels) == {"OST_Rooms"}
    extra = ["Room Number", "Room Name", "Area (m²)", "Room Status"] if rooms_only else []
    headers = COMMON_HEADERS + extra + (["Issue"] if criteria else [])
    r = new_result(mode, headers)
    if bad:
        r["note"] = "Categories not resolved (ignored): " + ", ".join(bad)

    by_cat = {}
    for e in population:
        if criteria:
            res, details = None, []
            for f in criteria:
                m, d = eval_filter(e, f)
                if res is None:
                    res = m
                elif f["op"] == "or":
                    res = res or m
                else:
                    res = res and m
                if m and d:
                    details.append(d)
            matched = bool(res)
        else:
            matched, details = True, []
        cn = cat_name(e) or "(no category)"
        bc = by_cat.setdefault(cn, [0, 0])
        bc[0] += 1
        if not matched:
            continue
        bc[1] += 1
        row = common_row(e)
        if rooms_only:
            area = safe(lambda: e.Area, 0.0) or 0.0
            if safe(lambda: e.Location, None) is None:
                st = "Not Placed"
            elif area <= 0:
                st = "Not Enclosed / Redundant"
            else:
                st = "Placed"
            row += [param_str(safe(lambda: e.get_Parameter(bip("ROOM_NUMBER")), None)) or "",
                    param_str(safe(lambda: e.get_Parameter(bip("ROOM_NAME")), None)) or "",
                    round(area * SQFT_TO_SQM, 2), st]
        if criteria:
            row.append("; ".join(details))
        r["rows"].append(row)
        r["ids"].append(row[0])

    r["rows"].sort(key=lambda x: (str(x[3]), str(x[4]), str(x[5]), x[0]))
    r["found"] = len(r["rows"])
    if mode == "compliance":
        r["checked"] = len(population)
        r["failed"] = r["found"]
        r["by_cat"] = by_cat
    else:
        r["checked"] = r["found"]
        r["failed"] = r["found"] if mode == "zero" else 0
        r["info"].append(("Elements by category", ", ".join(
            "%s: %d" % (k, v[1]) for k, v in sorted(by_cat.items()) if v[1])))
    return r


# =====================================================================
# PREBUILT CHECKS
# =====================================================================
def chk_phase(chk):
    r = new_result("info", COMMON_HEADERS + ["Phase Demolished"])
    phases = [p for p in doc.Phases]
    pname = dict((idval(p.Id), p.Name) for p in phases)
    counts = {}
    for e in fec().WhereElementIsNotElementType():
        try:
            if e.Category is None or e.Category.CategoryType != DB.CategoryType.Model:
                continue
            v = idval(e.CreatedPhaseId)
        except Exception:
            continue
        if v not in pname:
            continue
        counts[v] = counts.get(v, 0) + 1
        if LIST_PHASE_ELEMENTS:
            r["rows"].append(common_row(e) + [name_of(e.DemolishedPhaseId)])
    for p in phases:
        r["info"].append(("Phase: " + p.Name, counts.get(idval(p.Id), 0)))
    r["rows"].sort(key=lambda x: (str(x[9]), str(x[3]), x[0]))
    r["found"] = r["checked"] = sum(counts.values())
    r["ids"] = [x[0] for x in r["rows"]]
    return r


def chk_coords(chk):
    r = new_result("info", ["Item", "Coordinates", "E / X (mm)", "N / Y (mm)", "Elev / Z (mm)", "Note"])
    try:
        pts = [("Project Base Point", DB.BasePoint.GetProjectBasePoint(doc)),
               ("Survey Point", DB.BasePoint.GetSurveyPoint(doc))]
    except Exception:
        pts = []
        for bp in fec().OfClass(DB.BasePoint):
            pts.append(("Survey Point" if bp.IsShared else "Project Base Point", bp))
    for label, bp in pts:
        try:
            p, s = bp.Position, bp.SharedPosition
            r["rows"].append([label, "Internal", round(p.X * FT_TO_MM, 3), round(p.Y * FT_TO_MM, 3),
                              round(p.Z * FT_TO_MM, 3), "Element ID %d" % idval(bp.Id)])
            r["rows"].append([label, "Shared", round(s.X * FT_TO_MM, 3), round(s.Y * FT_TO_MM, 3),
                              round(s.Z * FT_TO_MM, 3), ""])
        except Exception as ex:
            r["rows"].append([label, "Error", "", "", "", str(ex)])
    try:
        loc = doc.ActiveProjectLocation
        pp = loc.GetProjectPosition(DB.XYZ.Zero)
        ang = pp.Angle * 180.0 / 3.141592653589793
        r["rows"].append(["Internal Origin -> Shared", "Project Position", round(pp.EastWest * FT_TO_MM, 3),
                          round(pp.NorthSouth * FT_TO_MM, 3), round(pp.Elevation * FT_TO_MM, 3),
                          "Angle to True North = %.6f°" % ang])
        r["info"].append(("Active Location", loc.Name))
        r["info"].append(("Angle to True North (°)", round(ang, 6)))
    except Exception:
        pass
    try:
        site = doc.SiteLocation
        r["info"].append(("Site Place Name", site.PlaceName))
        r["info"].append(("Latitude / Longitude (°)", "%.6f / %.6f" % (site.Latitude * 57.29577951308232,
                                                                        site.Longitude * 57.29577951308232)))
    except Exception:
        pass
    r["found"] = r["checked"] = len(r["rows"])
    return r


def chk_projinfo(chk):
    r = new_result("info", ["Parameter", "Value", "Has Value", "Shared Parameter", "Read Only"])
    pi = doc.ProjectInformation
    rows = []
    for p in pi.Parameters:
        n = safe(lambda: p.Definition.Name)
        if not n or n.startswith("Extensions"):
            continue
        v = param_str(p) or ""
        rows.append([n, v, yn(v.strip() != ""), yn(safe(lambda: p.IsShared, False)),
                     yn(safe(lambda: p.IsReadOnly, False))])
    rows.sort(key=lambda x: x[0].lower())
    r["rows"] = rows
    empty = len([x for x in rows if x[2] == "No"])
    r["info"].append(("Parameters with value", "%d / %d" % (len(rows) - empty, len(rows))))
    r["found"] = r["checked"] = len(rows)
    return r


def _ext_path(t):
    try:
        ref = t.GetExternalFileReference()
        return (DB.ModelPathUtils.ConvertModelPathToUserVisiblePath(ref.GetAbsolutePath()),
                str(ref.GetLinkedFileStatus()), str(ref.PathType))
    except Exception:
        return "", "", ""


def chk_linked_cad(chk):
    r = new_result("zero", ["Element ID", "Unique ID (GUID)", "File Name", "View Specific", "Owner View",
                            "Pinned", "Workset", "Path", "Status", "Path Type"])
    for ii in fec().OfClass(DB.ImportInstance):
        if not ii.IsLinked:
            continue
        t = doc.GetElement(ii.GetTypeId())
        path, status, ptype = _ext_path(t)
        r["rows"].append([idval(ii.Id), ii.UniqueId, cat_name(ii), yn(ii.ViewSpecific),
                          name_of(ii.OwnerViewId), yn(ii.Pinned), workset_name(ii), path, status, ptype])
    r["found"] = r["checked"] = r["failed"] = len(r["rows"])
    r["ids"] = [x[0] for x in r["rows"]]
    return r


def chk_imported_skp(chk):
    r = new_result("zero", ["Element ID", "Unique ID (GUID)", "File Name", "Linked / Imported",
                            "View Specific", "Owner View", "Workset"])
    for ii in fec().OfClass(DB.ImportInstance):
        n = cat_name(ii)
        t = doc.GetElement(ii.GetTypeId())
        if not (n.lower().endswith(".skp") or elem_name(t).lower().endswith(".skp")):
            continue
        r["rows"].append([idval(ii.Id), ii.UniqueId, n, "Linked" if ii.IsLinked else "Imported",
                          yn(ii.ViewSpecific), name_of(ii.OwnerViewId), workset_name(ii)])
    r["found"] = r["checked"] = r["failed"] = len(r["rows"])
    r["ids"] = [x[0] for x in r["rows"]]
    return r


def chk_link_method(chk):
    r = new_result("info", ["Type ID", "Unique ID (GUID)", "Link Name", "Attachment Type", "Path Type",
                            "Loaded", "Instances", "Path", "Status"])
    inst = {}
    for li in fec().OfClass(DB.RevitLinkInstance):
        k = idval(li.GetTypeId())
        inst[k] = inst.get(k, 0) + 1
    for t in fec().OfClass(DB.RevitLinkType):
        path, status, ptype = _ext_path(t)
        r["rows"].append([idval(t.Id), t.UniqueId, elem_name(t), str(safe(lambda: t.AttachmentType)),
                          ptype or str(safe(lambda: t.PathType)),
                          yn(safe(lambda: DB.RevitLinkType.IsLoaded(doc, t.Id), False)),
                          inst.get(idval(t.Id), 0), path, status])
    att = len([x for x in r["rows"] if "Attach" in x[3]])
    r["info"].append(("Overlay / Attachment", "%d / %d" % (len(r["rows"]) - att, att)))
    r["found"] = r["checked"] = len(r["rows"])
    r["ids"] = [x[0] for x in r["rows"]]
    return r


def chk_raster(chk):
    r = new_result("zero", ["Element ID", "Unique ID (GUID)", "Name", "Owner View", "Type", "Path", "Workset"])
    for e in fec().OfCategory(DB.BuiltInCategory.OST_RasterImages).WhereElementIsNotElementType():
        t = get_type(e)
        r["rows"].append([idval(e.Id), e.UniqueId, elem_name(e), name_of(safe(lambda: e.OwnerViewId,
                          DB.ElementId.InvalidElementId)), elem_name(t), safe(lambda: t.Path), workset_name(e)])
    types = list(fec().OfClass(DB.ImageType))
    r["info"].append(("Image types in project", len(types)))
    r["found"] = r["checked"] = r["failed"] = len(r["rows"])
    r["ids"] = [x[0] for x in r["rows"]]
    return r


def chk_unused(chk):
    r = new_result("zero", ["Element ID", "Unique ID (GUID)", "Category", "Class", "Family", "Name"])
    ids = None
    try:
        ids = list(doc.GetUnusedElements(HashSet[DB.ElementId]()))   # Revit 2024+
        r["note"] = "Source: Document.GetUnusedElements (same as Purge Unused)."
    except Exception:
        try:
            rid = DB.PerformanceAdviserRuleId(System.Guid("e8c63650-70b7-435a-9010-ec97660c1bda"))
            msgs = DB.PerformanceAdviser.GetPerformanceAdviser().ExecuteRules(
                doc, List[DB.PerformanceAdviserRuleId]([rid]))
            ids = []
            for m in msgs:
                ids += list(m.GetFailingElements())
            r["note"] = "Source: Performance Adviser 'unused families and types' (Revit < 2024)."
        except Exception as ex:
            r["note"] = "Unused elements could not be evaluated: " + str(ex)
            ids = []
    for i in ids:
        e = doc.GetElement(i)
        if e is None:
            continue
        r["rows"].append([idval(e.Id), e.UniqueId, cat_name(e), e.GetType().Name, family_info(e)[0], elem_name(e)])
    r["rows"].sort(key=lambda x: (str(x[2]), str(x[4]), str(x[5])))
    r["found"] = r["checked"] = r["failed"] = len(r["rows"])
    r["ids"] = [x[0] for x in r["rows"]]
    return r


def chk_worksets(chk):
    r = new_result("info", ["Workset ID", "Workset Name", "Open", "Visible by Default", "Owner",
                            "Editable", "Element Count"])
    if not doc.IsWorkshared:
        r["info"].append(("Worksharing", "*Not Workshared*"))
        return r
    for ws in DB.FilteredWorksetCollector(doc).OfKind(DB.WorksetKind.UserWorkset):
        cnt = safe(lambda: fec().WherePasses(DB.ElementWorksetFilter(ws.Id, False))
                   .WhereElementIsNotElementType().GetElementCount(), "")
        r["rows"].append([ws.Id.IntegerValue, ws.Name, yn(ws.IsOpen), yn(ws.IsVisibleByDefault),
                          ws.Owner, yn(ws.IsEditable), cnt])
    r["found"] = r["checked"] = len(r["rows"])
    return r


def chk_design_options(chk):
    r = new_result("info", ["Element ID", "Unique ID (GUID)", "Option Set", "Design Option", "Primary",
                            "Element Count"])
    b = bip("OPTION_SET_ID")
    for o in fec().OfClass(DB.DesignOption):
        oset = ""
        try:
            oset = name_of(o.get_Parameter(b).AsElementId())
        except Exception:
            pass
        cnt = safe(lambda: fec().WherePasses(DB.ElementDesignOptionFilter(o.Id)).GetElementCount(), "")
        r["rows"].append([idval(o.Id), o.UniqueId, oset, elem_name(o), yn(o.IsPrimary), cnt])
    r["found"] = r["checked"] = len(r["rows"])
    r["ids"] = [x[0] for x in r["rows"]]
    return r


def chk_warnings(chk):
    r = new_result("zero", ["No.", "Warning", "Severity", "Element Count", "Element IDs (Select by ID)",
                            "Unique IDs", "Categories"])
    groups = {}
    allids = []
    for i, w in enumerate(doc.GetWarnings(), 1):
        ids = list(w.GetFailingElements()) + list(w.GetAdditionalElements())
        els = [doc.GetElement(x) for x in ids]
        desc = w.GetDescriptionText()
        groups[desc] = groups.get(desc, 0) + 1
        nums = [idval(x) for x in ids]
        allids += nums
        r["rows"].append([i, desc, str(w.GetSeverity()), len(ids), ";".join(str(n) for n in nums),
                          "; ".join(e.UniqueId for e in els if e is not None),
                          ", ".join(sorted(set(cat_name(e) for e in els if e is not None)))])
    for d, c in sorted(groups.items(), key=lambda x: -x[1]):
        r["info"].append(("[%d] %s" % (c, d[:200]), ""))
    r["found"] = r["checked"] = r["failed"] = len(r["rows"])
    r["ids"] = sorted(set(allids))
    return r


GRAPHIC_VIEWS = set(["FloorPlan", "CeilingPlan", "Elevation", "Section", "ThreeD", "EngineeringPlan",
                     "AreaPlan", "Detail"])


def chk_hidden(chk):
    r = new_result("zero", ["View ID", "View Name", "View Type", "Hidden Elements", "Hidden Element IDs (first 200)"])
    views = [v for v in fec().OfClass(DB.View) if not v.IsTemplate and str(v.ViewType) in GRAPHIC_VIEWS]
    elems = [e for e in fec().WhereElementIsNotElementType()
             if e.Category is not None and e.Category.CategoryType == DB.CategoryType.Model
             and idval(e.OwnerViewId) < 0]
    for v in views:
        hid = []
        for e in elems:
            try:
                if e.IsHidden(v):
                    hid.append(idval(e.Id))
            except Exception:
                pass
        if hid:
            r["rows"].append([idval(v.Id), v.Name, str(v.ViewType), len(hid), ";".join(str(x) for x in hid[:200])])
    r["rows"].sort(key=lambda x: -x[3])
    r["found"] = r["checked"] = r["failed"] = len(r["rows"])
    r["ids"] = [x[0] for x in r["rows"]]
    return r


def chk_file_size(chk):
    r = new_result("info", ["Item", "Path", "Size (MB)"])
    p = doc.PathName
    if p and os.path.exists(p):
        r["rows"].append(["Local / Opened model", p, round(os.path.getsize(p) / 1048576.0, 2)])
    else:
        r["note"] = "Model file not found on disk (cloud model or unsaved)."
    if doc.IsWorkshared:
        try:
            cp = DB.ModelPathUtils.ConvertModelPathToUserVisiblePath(doc.GetWorksharingCentralModelPath())
            if cp and os.path.exists(cp):
                r["rows"].append(["Central model", cp, round(os.path.getsize(cp) / 1048576.0, 2)])
        except Exception:
            pass
    r["found"] = r["checked"] = len(r["rows"])
    return r


def chk_largest_families(chk):
    r = new_result("info", ["Rank", "Family ID", "Unique ID (GUID)", "Family", "Category", "Size (KB)"])
    TransactionManager.Instance.ForceCloseTransaction()
    tmp = os.path.join(os.environ.get("TEMP", os.path.expanduser("~")), "AA_ModelChecker_Families")
    if not os.path.exists(tmp):
        os.makedirs(tmp)
    sizes = []
    for f in fec().OfClass(DB.Family):
        if f.IsInPlace or not f.IsEditable:
            continue
        fp = os.path.join(tmp, re.sub(r'[\\/:*?"<>|]', "_", f.Name) + ".rfa")
        try:
            fd = doc.EditFamily(f)
            opt = DB.SaveAsOptions()
            opt.OverwriteExistingFile = True
            fd.SaveAs(fp, opt)
            fd.Close(False)
            sizes.append((os.path.getsize(fp) / 1024.0, f))
            os.remove(fp)
        except Exception:
            pass
    sizes.sort(key=lambda x: -x[0])
    for i, (s, f) in enumerate(sizes, 1):
        r["rows"].append([i, idval(f.Id), f.UniqueId, f.Name, safe(lambda: f.FamilyCategory.Name), round(s, 1)])
    r["note"] = "All editable loadable families listed; ranks 1-10 = the ten largest."
    r["found"] = r["checked"] = len(r["rows"])
    r["ids"] = [x[1] for x in r["rows"][:10]]
    return r


PREBUILT = {
    "PhaseElements": chk_phase,
    "ProjectCoordinates": chk_coords,
    "ProjectInformation": chk_projinfo,
    "LinkedCad": chk_linked_cad,
    "LinkMethod": chk_link_method,
    "RasterImages": chk_raster,
    "UnusedElements": chk_unused,
    "ImportedSkp": chk_imported_skp,
    "Worksets": chk_worksets,
    "DesignOptions": chk_design_options,
    "WarningCount": chk_warnings,
    "ViewsWithHiddenElements": chk_hidden,
    "FileSize": chk_file_size,
    "TenLargestFamilies": chk_largest_families,
}


# =====================================================================
# RULE PARSER  (Dynamo Code Block dictionaries -> normalized checks)
# =====================================================================
VALID_CONDITIONS = set(["hasvalue", "hasnovalue", "exists", "defined", "doesnotexist", "notexists",
                        "undefined", "equal", "equals", "isequalto", "notequal", "doesnotequal",
                        "notequals", "contains", "doesnotcontain", "notcontains", "beginswith",
                        "startswith", "doesnotbeginwith", "doesnotstartwith", "endswith",
                        "doesnotendwith", "matchesregex", "regex", "wildcard", "doesnotmatchregex",
                        "notregex", "wildcardnomatch", "greaterthan", "greaterthanorequal",
                        "lessthan", "lessthanorequal", "included", "excluded"])
VALID_SOURCES = set(["parameter", "family", "type", "category", "class", "apiclass", "apitype"])
VALID_MODES = {"auto": "auto", "compliance": "compliance", "zero": "zero", "mustbezero": "zero",
               "info": "info", "information": "info"}
VALID_ET = {"instance": "instance", "instances": "instance", "type": "type", "types": "type",
            "both": "both", "all": "both"}


def is_seq(x):
    if x is None or isinstance(x, (str, bytes, dict)):
        return False
    if isinstance(x, (list, tuple)):
        return True
    try:
        if hasattr(x, "Keys") and hasattr(x, "Values"):
            return False
        iter(x)
        return True
    except Exception:
        return False


def to_py(x):
    if x is None or isinstance(x, (str, bool, int, float)):
        return x
    if isinstance(x, dict):
        return dict((str(k), to_py(v)) for k, v in x.items())
    if hasattr(x, "Keys") and (hasattr(x, "ValueAtKey") or hasattr(x, "Values")):
        try:
            keys = [str(k) for k in x.Keys]
            if hasattr(x, "ValueAtKey"):
                return dict((k, to_py(x.ValueAtKey(k))) for k in keys)
            return dict(zip(keys, [to_py(v) for v in x.Values]))
        except Exception:
            pass
    if is_seq(x):
        return [to_py(v) for v in x]
    return x


def flatten_rules(x, out):
    x = to_py(x)
    if isinstance(x, dict):
        out.append(x)
    elif isinstance(x, list):
        for v in x:
            flatten_rules(v, out)
    return out


def _get(d, key, default=None):
    lk = key.lower().replace(" ", "")
    for k, v in d.items():
        if str(k).lower().replace(" ", "") == lk:
            return default if v is None else v
    return default


def _bool(v, default=False):
    if v is None or v == "":
        return default
    if isinstance(v, bool):
        return v
    return str(v).strip().lower() in ("true", "yes", "1", "y", "on")


def _str(v):
    return "" if v is None else str(v)


def parse_filter(f, idx, rname, msgs):
    if isinstance(f, dict):
        src, prop = _get(f, "Source", _get(f, "Category", "")), _get(f, "Property", "")
        cond, val = _get(f, "Condition", ""), _get(f, "Value", "")
        op, ci = _get(f, "Operator", "And"), _get(f, "CaseInsensitive", False)
    elif isinstance(f, list):
        if len(f) < 3:
            msgs.append("[%s] filter %d ignored: needs at least [Source, Property, Condition]" % (rname, idx))
            return None
        src, prop, cond = f[0], f[1], f[2]
        val = f[3] if len(f) > 3 else ""
        op = f[4] if len(f) > 4 else "And"
        ci = f[5] if len(f) > 5 else False
    else:
        msgs.append("[%s] filter %d ignored: not a list" % (rname, idx))
        return None
    if isinstance(val, bool):
        val = "True" if val else "False"
    nf = {"src": _str(src).strip(), "prop": _str(prop).strip(), "cond": _str(cond).strip(),
          "val": _str(val), "op": _str(op).strip().lower() or "and", "ci": _bool(ci)}
    if nf["src"].lower() not in VALID_SOURCES:
        msgs.append("[%s] filter %d: unknown Source '%s'" % (rname, idx, nf["src"]))
    if nf["cond"].lower() not in VALID_CONDITIONS:
        msgs.append("[%s] filter %d: unknown Condition '%s'" % (rname, idx, nf["cond"]))
    if nf["op"] not in ("and", "or"):
        msgs.append("[%s] filter %d: Operator must be And / Or (got '%s'), using And" % (rname, idx, op))
        nf["op"] = "and"
    return nf


def parse_rules(raw):
    msgs = []
    checks = []
    for i, d in enumerate(flatten_rules(raw, []), 1):
        name = _str(_get(d, "Name", "")).strip() or ("Rule %02d" % i)
        if not _get(d, "Name"):
            msgs.append("Rule %d has no Name - named '%s'" % (i, name))
        ctype = _str(_get(d, "Type", "Custom")).strip() or "Custom"
        if ctype.lower() == "custom":
            ctype = "Custom"
        else:
            hit = [k for k in PREBUILT if k.lower() == ctype.lower()]
            if hit:
                ctype = hit[0]
            else:
                msgs.append("[%s] unknown Type '%s'" % (name, ctype))
        mode_raw = _str(_get(d, "Mode", "Auto")).strip().lower().replace(" ", "") or "auto"
        mode = VALID_MODES.get(mode_raw)
        if mode is None:
            msgs.append("[%s] unknown Mode '%s' - using Auto" % (name, mode_raw))
            mode = "auto"
        et_raw = _str(_get(d, "ElementType", "Instance")).strip().lower() or "instance"
        et = VALID_ET.get(et_raw)
        if et is None:
            msgs.append("[%s] unknown ElementType '%s' - using Instance" % (name, et_raw))
            et = "instance"
        cats = _get(d, "Categories", []) or []
        if not isinstance(cats, list):
            cats = [cats]
        flts = _get(d, "Filters", []) or []
        if isinstance(flts, list) and flts and not isinstance(flts[0], (list, dict)):
            flts = [flts]
        filters = []
        for k, f in enumerate(flts if isinstance(flts, list) else [flts], 1):
            nf = parse_filter(f, k, name, msgs)
            if nf is not None:
                filters.append(nf)
        if ctype == "Custom" and not cats and not filters:
            msgs.append("[%s] custom rule has no Categories and no Filters - it will list every element" % name)
        checks.append({
            "heading": _str(_get(d, "Heading", "")), "section": _str(_get(d, "Section", "")),
            "name": name, "desc": _str(_get(d, "Description", "")),
            "ctype": ctype, "mode": mode, "element_type": et,
            "required": _bool(_get(d, "Required"), False),
            "enabled": _bool(_get(d, "Enabled"), True),
            "categories": cats, "filters": filters,
            "options": _get(d, "Options", {}) or {},
        })
    return checks, msgs


def apply_options(opt):
    opt = to_py(opt)
    if not isinstance(opt, dict):
        return []
    msgs = []
    g = globals()
    for k, v in opt.items():
        key = OPTION_KEYS.get(str(k).lower().replace(" ", "").replace("_", ""))
        if key is None:
            msgs.append("Unknown global option '%s' ignored" % k)
            continue
        cur = g[key]
        if isinstance(cur, bool):
            g[key] = _bool(v, cur)
        elif isinstance(cur, int):
            try:
                g[key] = int(v)
            except Exception:
                msgs.append("Option '%s' must be a number" % k)
        else:
            g[key] = _str(v)
    return msgs


def finalize(chk, r):
    mode = r["mode"]
    comp = None
    if mode == "compliance":
        if r["checked"]:
            comp = float(r["checked"] - r["failed"]) / r["checked"]
            status = "PASS" if r["failed"] == 0 else "FAIL"
        else:
            status = "INFO"
            r["note"] = (r["note"] + " " if r["note"] else "") + "No elements in scope."
    elif mode == "zero":
        status = "PASS" if r["found"] == 0 else "REVIEW"
    else:
        status = "FAIL" if (chk["required"] and r["found"] == 0) else "INFO"
    r["status"], r["completion"] = status, comp
    return r


def run_check(chk):
    if not chk["enabled"]:
        r = new_result("info", ["Note"])
        r["status"], r["completion"] = "SKIPPED", None
        r["note"] = "Rule is disabled in Dynamo (Enable toggle = False)."
        return r
    try:
        if chk["ctype"] == "Custom":
            r = run_custom(chk)
        elif chk["ctype"] in PREBUILT:
            r = PREBUILT[chk["ctype"]](chk)
            if chk["mode"] != "auto":
                r["mode"] = chk["mode"]
                if chk["mode"] == "zero":
                    r["failed"] = r["found"]
        else:
            r = new_result("info", ["Note"])
            r["status"], r["completion"] = "SKIPPED", None
            r["note"] = "Check type '%s' is not implemented." % chk["ctype"]
            return r
        return finalize(chk, r)
    except Exception:
        r = new_result("info", ["Error"])
        r["rows"] = [[line] for line in traceback.format_exc().splitlines()]
        r["status"], r["completion"], r["note"] = "ERROR", None, "Check failed to run - see error below."
        return r


# =====================================================================
# MINIMAL XLSX WRITER (standard library only)
# =====================================================================
S_DEFAULT, S_HEADER, S_TITLE, S_PCT, S_PASS, S_FAIL, S_REVIEW, S_INFO, S_CELL, S_LINK, \
    S_BOLD, S_SUB, S_KPI_PCT, S_INT, S_GREY, S_KPI, S_WRAP, S_KPI_LABEL = range(18)
STATUS_STYLE = {"PASS": S_PASS, "FAIL": S_FAIL, "REVIEW": S_REVIEW, "INFO": S_INFO,
                "SKIPPED": S_GREY, "ERROR": S_FAIL}
STATUS_TAB = {"PASS": "FF70AD47", "FAIL": "FFC00000", "REVIEW": "FFFFC000", "INFO": "FF5B9BD5",
              "SKIPPED": "FFA6A6A6", "ERROR": "FFC00000"}
NO_MEASURE = (S_TITLE, S_SUB, S_WRAP, S_KPI, S_KPI_PCT, S_KPI_LABEL)
_BAD_XML = re.compile(u"[\x00-\x08\x0b\x0c\x0e-\x1f\ufffe\uffff]")


def col_letter(c):
    s = ""
    while c > 0:
        c, rem = divmod(c - 1, 26)
        s = chr(65 + rem) + s
    return s


def ref(r, c):
    return "%s%d" % (col_letter(c), r)


def esc(s):
    s = _BAD_XML.sub("", s)
    if len(s) > 32000:
        s = s[:32000] + "...(truncated)"
    return s.replace("&", "&amp;").replace("<", "&lt;").replace(">", "&gt;").replace('"', "&quot;")


class Sheet(object):
    def __init__(self, name):
        self.name = name
        self.cells = {}
        self.links = []
        self.merges = []
        self.widths = {}
        self.freeze_row = None
        self.autofilter = None
        self.databars = []
        self.tab = None

    def set(self, r, c, v, s=S_DEFAULT):
        self.cells.setdefault(r, {})[c] = (v, s)
        if v is not None and s not in NO_MEASURE:
            if isinstance(v, float) and s in (S_PCT,):
                ln = 8
            else:
                ln = max(len(x) for x in str(v).split("\n")) if str(v) else 0
            self.widths[c] = max(self.widths.get(c, 0), min(ln, 60))

    def row(self, r, values, s=S_DEFAULT, start=1):
        for i, v in enumerate(values):
            if isinstance(v, tuple):
                self.set(r, start + i, v[0], v[1])
            else:
                self.set(r, start + i, v, s)

    def link(self, r, c, text, sheet_name, s=S_LINK):
        self.set(r, c, text, s)
        self.links.append((ref(r, c), "'%s'!A1" % sheet_name.replace("'", "''"), text))

    def xml(self, selected=False):
        out = ['<?xml version="1.0" encoding="UTF-8" standalone="yes"?>',
               '<worksheet xmlns="http://schemas.openxmlformats.org/spreadsheetml/2006/main" '
               'xmlns:r="http://schemas.openxmlformats.org/officeDocument/2006/relationships">']
        if self.tab:
            out.append('<sheetPr><tabColor rgb="%s"/></sheetPr>' % self.tab)
        maxr = max(self.cells) if self.cells else 1
        maxc = max([max(v) for v in self.cells.values() if v] or [1])
        out.append('<dimension ref="A1:%s"/>' % ref(maxr, maxc))
        sv = '<sheetView workbookViewId="0" showGridLines="0"%s>' % (' tabSelected="1"' if selected else '')
        if self.freeze_row:
            sv += ('<pane ySplit="%d" topLeftCell="A%d" activePane="bottomLeft" state="frozen"/>'
                   '<selection pane="bottomLeft" activeCell="A%d" sqref="A%d"/>'
                   % (self.freeze_row, self.freeze_row + 1, self.freeze_row + 1, self.freeze_row + 1))
        out.append('<sheetViews>%s</sheetView></sheetViews>' % sv)
        out.append('<sheetFormatPr defaultRowHeight="15"/>')
        if self.widths:
            out.append("<cols>")
            for c in sorted(self.widths):
                out.append('<col min="%d" max="%d" width="%.1f" customWidth="1"/>'
                           % (c, c, max(8, min(self.widths[c] * 1.1 + 2, 65))))
            out.append("</cols>")
        out.append("<sheetData>")
        for r in sorted(self.cells):
            cells = self.cells[r]
            out.append('<row r="%d">' % r)
            for c in sorted(cells):
                v, s = cells[c]
                rf = ref(r, c)
                if v is None or v == "":
                    out.append('<c r="%s" s="%d"/>' % (rf, s))
                elif isinstance(v, bool):
                    out.append('<c r="%s" s="%d" t="inlineStr"><is><t>%s</t></is></c>' % (rf, s, "Yes" if v else "No"))
                elif isinstance(v, (int, float)) and v == v and abs(v) != float("inf"):
                    out.append('<c r="%s" s="%d"><v>%s</v></c>' % (rf, s, repr(v) if isinstance(v, float) else str(v)))
                else:
                    out.append('<c r="%s" s="%d" t="inlineStr"><is><t xml:space="preserve">%s</t></is></c>'
                               % (rf, s, esc(str(v))))
            out.append("</row>")
        out.append("</sheetData>")
        if self.autofilter:
            out.append('<autoFilter ref="%s"/>' % self.autofilter)
        if self.merges:
            out.append('<mergeCells count="%d">%s</mergeCells>'
                       % (len(self.merges), "".join('<mergeCell ref="%s"/>' % m for m in self.merges)))
        for i, rng in enumerate(self.databars, 1):
            out.append('<conditionalFormatting sqref="%s"><cfRule type="dataBar" priority="%d"><dataBar>'
                       '<cfvo type="num" val="0"/><cfvo type="num" val="1"/><color rgb="FF63BE7B"/>'
                       '</dataBar></cfRule></conditionalFormatting>' % (rng, i))
        if self.links:
            out.append("<hyperlinks>%s</hyperlinks>" % "".join(
                '<hyperlink ref="%s" location="%s" display="%s"/>' % (rf, esc(loc), esc(str(d)))
                for rf, loc, d in self.links))
        out.append('<pageMargins left="0.7" right="0.7" top="0.75" bottom="0.75" header="0.3" footer="0.3"/>')
        out.append("</worksheet>")
        return "".join(out)


STYLES_XML = (
    '<?xml version="1.0" encoding="UTF-8" standalone="yes"?>'
    '<styleSheet xmlns="http://schemas.openxmlformats.org/spreadsheetml/2006/main">'
    '<fonts count="12">'
    '<font><sz val="10"/><color rgb="FF000000"/><name val="Calibri"/><family val="2"/></font>'
    '<font><b/><sz val="10"/><color rgb="FFFFFFFF"/><name val="Calibri"/><family val="2"/></font>'
    '<font><b/><sz val="16"/><color rgb="FF1F4E79"/><name val="Calibri"/><family val="2"/></font>'
    '<font><b/><sz val="10"/><color rgb="FF006100"/><name val="Calibri"/><family val="2"/></font>'
    '<font><b/><sz val="10"/><color rgb="FF9C0006"/><name val="Calibri"/><family val="2"/></font>'
    '<font><b/><sz val="10"/><color rgb="FF9C5700"/><name val="Calibri"/><family val="2"/></font>'
    '<font><b/><sz val="10"/><color rgb="FF1F4E79"/><name val="Calibri"/><family val="2"/></font>'
    '<font><u/><sz val="10"/><color rgb="FF0563C1"/><name val="Calibri"/><family val="2"/></font>'
    '<font><b/><sz val="10"/><color rgb="FF000000"/><name val="Calibri"/><family val="2"/></font>'
    '<font><i/><sz val="10"/><color rgb="FF595959"/><name val="Calibri"/><family val="2"/></font>'
    '<font><b/><sz val="20"/><color rgb="FF1F4E79"/><name val="Calibri"/><family val="2"/></font>'
    '<font><sz val="9"/><color rgb="FF595959"/><name val="Calibri"/><family val="2"/></font>'
    '</fonts>'
    '<fills count="9">'
    '<fill><patternFill patternType="none"/></fill>'
    '<fill><patternFill patternType="gray125"/></fill>'
    '<fill><patternFill patternType="solid"><fgColor rgb="FF1F4E79"/><bgColor indexed="64"/></patternFill></fill>'
    '<fill><patternFill patternType="solid"><fgColor rgb="FFC6EFCE"/><bgColor indexed="64"/></patternFill></fill>'
    '<fill><patternFill patternType="solid"><fgColor rgb="FFFFC7CE"/><bgColor indexed="64"/></patternFill></fill>'
    '<fill><patternFill patternType="solid"><fgColor rgb="FFFFEB9C"/><bgColor indexed="64"/></patternFill></fill>'
    '<fill><patternFill patternType="solid"><fgColor rgb="FFDDEBF7"/><bgColor indexed="64"/></patternFill></fill>'
    '<fill><patternFill patternType="solid"><fgColor rgb="FFE7E6E6"/><bgColor indexed="64"/></patternFill></fill>'
    '<fill><patternFill patternType="solid"><fgColor rgb="FFF2F2F2"/><bgColor indexed="64"/></patternFill></fill>'
    '</fills>'
    '<borders count="2"><border><left/><right/><top/><bottom/><diagonal/></border>'
    '<border><left style="thin"><color rgb="FFBFBFBF"/></left><right style="thin"><color rgb="FFBFBFBF"/></right>'
    '<top style="thin"><color rgb="FFBFBFBF"/></top><bottom style="thin"><color rgb="FFBFBFBF"/></bottom>'
    '<diagonal/></border></borders>'
    '<cellStyleXfs count="1"><xf numFmtId="0" fontId="0" fillId="0" borderId="0"/></cellStyleXfs>'
    '<cellXfs count="18">'
    '<xf numFmtId="0" fontId="0" fillId="0" borderId="0" xfId="0"/>'                                      # 0 default
    '<xf numFmtId="0" fontId="1" fillId="2" borderId="1" xfId="0" applyFont="1" applyFill="1" applyBorder="1" applyAlignment="1"><alignment horizontal="center" vertical="center" wrapText="1"/></xf>'  # 1 header
    '<xf numFmtId="0" fontId="2" fillId="0" borderId="0" xfId="0" applyFont="1"/>'                        # 2 title
    '<xf numFmtId="10" fontId="0" fillId="0" borderId="1" xfId="0" applyNumberFormat="1" applyBorder="1" applyAlignment="1"><alignment horizontal="center"/></xf>'  # 3 pct
    '<xf numFmtId="0" fontId="3" fillId="3" borderId="1" xfId="0" applyFont="1" applyFill="1" applyBorder="1" applyAlignment="1"><alignment horizontal="center"/></xf>'  # 4 pass
    '<xf numFmtId="0" fontId="4" fillId="4" borderId="1" xfId="0" applyFont="1" applyFill="1" applyBorder="1" applyAlignment="1"><alignment horizontal="center"/></xf>'  # 5 fail
    '<xf numFmtId="0" fontId="5" fillId="5" borderId="1" xfId="0" applyFont="1" applyFill="1" applyBorder="1" applyAlignment="1"><alignment horizontal="center"/></xf>'  # 6 review
    '<xf numFmtId="0" fontId="6" fillId="6" borderId="1" xfId="0" applyFont="1" applyFill="1" applyBorder="1" applyAlignment="1"><alignment horizontal="center"/></xf>'  # 7 info
    '<xf numFmtId="0" fontId="0" fillId="0" borderId="1" xfId="0" applyBorder="1"/>'                      # 8 cell
    '<xf numFmtId="0" fontId="7" fillId="0" borderId="1" xfId="0" applyFont="1" applyBorder="1"/>'        # 9 link
    '<xf numFmtId="0" fontId="8" fillId="8" borderId="1" xfId="0" applyFont="1" applyFill="1" applyBorder="1"/>'  # 10 bold label
    '<xf numFmtId="0" fontId="9" fillId="0" borderId="0" xfId="0" applyFont="1"/>'                        # 11 subtitle
    '<xf numFmtId="10" fontId="10" fillId="0" borderId="1" xfId="0" applyNumberFormat="1" applyFont="1" applyBorder="1" applyAlignment="1"><alignment horizontal="center" vertical="center"/></xf>'  # 12 kpi pct
    '<xf numFmtId="3" fontId="0" fillId="0" borderId="1" xfId="0" applyNumberFormat="1" applyBorder="1" applyAlignment="1"><alignment horizontal="center"/></xf>'  # 13 int
    '<xf numFmtId="0" fontId="8" fillId="7" borderId="1" xfId="0" applyFont="1" applyFill="1" applyBorder="1" applyAlignment="1"><alignment horizontal="center"/></xf>'  # 14 grey
    '<xf numFmtId="0" fontId="10" fillId="0" borderId="1" xfId="0" applyFont="1" applyBorder="1" applyAlignment="1"><alignment horizontal="center" vertical="center"/></xf>'  # 15 kpi
    '<xf numFmtId="0" fontId="0" fillId="0" borderId="1" xfId="0" applyBorder="1" applyAlignment="1"><alignment vertical="top" wrapText="1"/></xf>'  # 16 wrap
    '<xf numFmtId="0" fontId="11" fillId="8" borderId="1" xfId="0" applyFont="1" applyFill="1" applyBorder="1" applyAlignment="1"><alignment horizontal="center" wrapText="1"/></xf>'  # 17 kpi label
    '</cellXfs>'
    '<cellStyles count="1"><cellStyle name="Normal" xfId="0" builtinId="0"/></cellStyles>'
    '</styleSheet>')


def save_xlsx(path, sheets):
    z = zipfile.ZipFile(path, "w", zipfile.ZIP_DEFLATED)
    ct = ['<?xml version="1.0" encoding="UTF-8" standalone="yes"?>'
          '<Types xmlns="http://schemas.openxmlformats.org/package/2006/content-types">'
          '<Default Extension="rels" ContentType="application/vnd.openxmlformats-package.relationships+xml"/>'
          '<Default Extension="xml" ContentType="application/xml"/>'
          '<Override PartName="/xl/workbook.xml" ContentType="application/vnd.openxmlformats-officedocument.spreadsheetml.sheet.main+xml"/>'
          '<Override PartName="/xl/styles.xml" ContentType="application/vnd.openxmlformats-officedocument.spreadsheetml.styles+xml"/>']
    for i in range(len(sheets)):
        ct.append('<Override PartName="/xl/worksheets/sheet%d.xml" '
                  'ContentType="application/vnd.openxmlformats-officedocument.spreadsheetml.worksheet+xml"/>' % (i + 1))
    ct.append("</Types>")
    z.writestr("[Content_Types].xml", "".join(ct))
    z.writestr("_rels/.rels",
               '<?xml version="1.0" encoding="UTF-8" standalone="yes"?>'
               '<Relationships xmlns="http://schemas.openxmlformats.org/package/2006/relationships">'
               '<Relationship Id="rId1" Type="http://schemas.openxmlformats.org/officeDocument/2006/relationships/officeDocument" Target="xl/workbook.xml"/>'
               '</Relationships>')
    wb = ['<?xml version="1.0" encoding="UTF-8" standalone="yes"?>'
          '<workbook xmlns="http://schemas.openxmlformats.org/spreadsheetml/2006/main" '
          'xmlns:r="http://schemas.openxmlformats.org/officeDocument/2006/relationships">'
          '<bookViews><workbookView activeTab="0"/></bookViews><sheets>']
    for i, s in enumerate(sheets):
        wb.append('<sheet name="%s" sheetId="%d" r:id="rId%d"/>' % (esc(s.name), i + 1, i + 1))
    wb.append("</sheets>")
    dn = []
    for i, s in enumerate(sheets):
        if s.autofilter:
            a, b = s.autofilter.split(":")
            ra = re.match(r"([A-Z]+)(\d+)", a).groups()
            rb = re.match(r"([A-Z]+)(\d+)", b).groups()
            dn.append('<definedName name="_xlnm._FilterDatabase" localSheetId="%d" hidden="1">\'%s\'!$%s$%s:$%s$%s</definedName>'
                      % (i, esc(s.name.replace("'", "''")), ra[0], ra[1], rb[0], rb[1]))
    if dn:
        wb.append("<definedNames>%s</definedNames>" % "".join(dn))
    wb.append("</workbook>")
    z.writestr("xl/workbook.xml", "".join(wb))
    rels = ['<?xml version="1.0" encoding="UTF-8" standalone="yes"?>'
            '<Relationships xmlns="http://schemas.openxmlformats.org/package/2006/relationships">']
    for i in range(len(sheets)):
        rels.append('<Relationship Id="rId%d" Type="http://schemas.openxmlformats.org/officeDocument/2006/relationships/worksheet" '
                    'Target="worksheets/sheet%d.xml"/>' % (i + 1, i + 1))
    rels.append('<Relationship Id="rId%d" Type="http://schemas.openxmlformats.org/officeDocument/2006/relationships/styles" '
                'Target="styles.xml"/></Relationships>' % (len(sheets) + 1))
    z.writestr("xl/_rels/workbook.xml.rels", "".join(rels))
    z.writestr("xl/styles.xml", STYLES_XML)
    for i, s in enumerate(sheets):
        z.writestr("xl/worksheets/sheet%d.xml" % (i + 1), s.xml(selected=(i == 0)))
    z.close()


def sheet_name(n, used):
    base = re.sub(r"[\[\]:*?/\\]", "", n).strip().strip("'") or "Check"
    base = base[:31]
    name, k = base, 2
    while name.lower() in used:
        suf = " (%d)" % k
        name = base[:31 - len(suf)] + suf
        k += 1
    used.add(name.lower())
    return name


# =====================================================================
# REPORT BUILDER
# =====================================================================
MODE_LABEL = {"compliance": "Compliance", "zero": "Must be zero", "info": "Information"}


def build_report(meta, model, checks, results, out_path):
    used = set(["summary"])
    names = []
    for i, c in enumerate(checks, 1):
        names.append(sheet_name("%02d %s" % (i, c["name"]), used))

    # ---------------- Summary ----------------
    sm = Sheet("Summary")
    sm.tab = "FF1F4E79"
    sm.set(1, 1, "Model Check Report  -  " + (meta.get("name") or "Model Checker"), S_TITLE)
    sm.set(2, 1, "Rules: %s   |   Author: %s" % (meta.get("file", ""), meta.get("author", "")), S_SUB)
    r = 4
    for k, v in model:
        sm.set(r, 1, k, S_BOLD)
        sm.set(r, 2, v, S_CELL)
        sm.merges.append("B%d:F%d" % (r, r))
        r += 1

    comp = [x for x in results if x["mode"] == "compliance" and x.get("completion") is not None]
    tot = sum(x["checked"] for x in comp)
    bad = sum(x["failed"] for x in comp)
    overall = float(tot - bad) / tot if tot else None
    scored = [x for x in results if x["status"] in ("PASS", "FAIL", "REVIEW")]
    npass = len([x for x in scored if x["status"] == "PASS"])
    cnt = dict((s, len([x for x in results if x["status"] == s]))
               for s in ("PASS", "FAIL", "REVIEW", "INFO", "SKIPPED", "ERROR"))

    r += 1
    kr = r
    kpis = [("Overall Data Completion\n(compliance checks)", overall if overall is not None else "N/A",
             S_KPI_PCT if overall is not None else S_KPI),
            ("Checks Passed", "%d / %d" % (npass, len(scored)), S_KPI),
            ("Elements Checked", tot, S_KPI),
            ("Elements Failed", bad, S_KPI),
            ("FAIL / REVIEW", "%d / %d" % (cnt["FAIL"], cnt["REVIEW"]), S_KPI),
            ("INFO / SKIPPED / ERROR", "%d / %d / %d" % (cnt["INFO"], cnt["SKIPPED"], cnt["ERROR"]), S_KPI)]
    for i, (lab, val, st) in enumerate(kpis):
        c = 1 + i * 2
        sm.set(kr, c, lab, S_KPI_LABEL)
        sm.set(kr, c + 1, None, S_KPI_LABEL)
        sm.merges.append("%s:%s" % (ref(kr, c), ref(kr, c + 1)))
        sm.set(kr + 1, c, val, st)
        sm.set(kr + 1, c + 1, None, st)
        sm.merges.append("%s:%s" % (ref(kr + 1, c), ref(kr + 1, c + 1)))
    if overall is not None:
        sm.databars.append(ref(kr + 1, 1))

    r = kr + 3
    sm.set(r, 1, "Check Results", S_TITLE)
    r += 1
    hdr = ["No.", "Heading", "Section", "Check", "Description", "Result Type", "Required",
           "In Scope", "Issues / Found", "Passed", "Completion", "Status", "Note", "Sheet"]
    sm.row(r, hdr, S_HEADER)
    first = r + 1
    for i, (c, res) in enumerate(zip(checks, results), 1):
        r += 1
        passed = ""
        if res["mode"] == "compliance" and res["checked"] is not None:
            passed = res["checked"] - res["failed"]
        issues = res["failed"] if res["mode"] in ("compliance", "zero") else res["found"]
        sm.row(r, [(i, S_INT), c["heading"], c["section"], (c["name"], S_BOLD), c["desc"],
                   MODE_LABEL.get(res["mode"], ""), yn(c["required"]),
                   (res["checked"] if res["checked"] is not None else "", S_INT),
                   (issues if res["status"] not in ("SKIPPED", "ERROR") else "", S_INT),
                   (passed, S_INT),
                   (res["completion"] if res["completion"] is not None else "-",
                    S_PCT if res["completion"] is not None else S_CELL),
                   (res["status"], STATUS_STYLE.get(res["status"], S_CELL)),
                   res.get("note", "")], S_CELL)
        sm.link(r, 14, "Open >>", names[i - 1])
    sm.databars.append("K%d:K%d" % (first, r))
    sm.widths[5] = 45
    sm.widths[13] = 45

    # completion by category
    r += 2
    sm.set(r, 1, "Completion by Category (compliance checks)", S_TITLE)
    r += 1
    sm.row(r, ["No.", "Check", "Category", "Elements", "Failed", "Passed", "Completion", "Status"], S_HEADER)
    cf = r + 1
    n = 0
    for c, res in zip(checks, results):
        if res["mode"] != "compliance" or not res.get("by_cat"):
            continue
        for cat, (t, f) in sorted(res["by_cat"].items()):
            n += 1
            r += 1
            st = "PASS" if f == 0 else "FAIL"
            sm.row(r, [(n, S_INT), c["name"], cat, (t, S_INT), (f, S_INT), (t - f, S_INT),
                       (float(t - f) / t if t else 0, S_PCT), (st, STATUS_STYLE[st])], S_CELL)
    if n:
        sm.databars.append("G%d:G%d" % (cf, r))

    sheets = [sm]

    # ---------------- Check sheets ----------------
    for i, (c, res) in enumerate(zip(checks, results)):
        sh = Sheet(names[i])
        sh.tab = STATUS_TAB.get(res["status"])
        sh.set(1, 1, "%02d  %s" % (i + 1, c["name"]), S_TITLE)
        sh.link(2, 1, "<< Back to Summary", "Summary", S_LINK)
        sh.set(3, 1, "%s  >  %s" % (c["heading"], c["section"]), S_SUB)
        sh.set(4, 1, c["desc"] or "", S_SUB)
        rr = 6
        stats = [("Status", (res["status"], STATUS_STYLE.get(res["status"], S_CELL))),
                 ("Result Type", MODE_LABEL.get(res["mode"], "")),
                 ("In Scope", res["checked"] if res["checked"] is not None else ""),
                 ("Issues / Found", res["failed"] if res["mode"] in ("compliance", "zero") else res["found"]),
                 ("Completion", (res["completion"], S_PCT) if res["completion"] is not None else "-")]
        for k, v in stats:
            sh.set(rr, 1, k, S_BOLD)
            if isinstance(v, tuple):
                sh.set(rr, 2, v[0], v[1])
            else:
                sh.set(rr, 2, v, S_CELL)
            rr += 1
        if res.get("note"):
            sh.set(rr, 1, "Note", S_BOLD)
            sh.set(rr, 2, res["note"], S_CELL)
            rr += 1
        for k, v in res.get("info", []):
            sh.set(rr, 1, k, S_BOLD)
            sh.set(rr, 2, v, S_CELL)
            rr += 1
        ids = res.get("ids") or []
        if ids:
            sh.set(rr, 1, "All IDs (copy to Manage > Select by ID)", S_BOLD)
            if len(ids) <= MAX_IDS_IN_CELL:
                sh.set(rr, 2, ";".join(str(x) for x in ids), S_CELL)
            else:
                sh.set(rr, 2, "%d IDs - too many for one cell, filter the table below and copy Element ID column."
                       % len(ids), S_CELL)
            rr += 1
        # keep column A/B width sane for label block
        sh.widths[1] = max(sh.widths.get(1, 0), 22)
        sh.widths[2] = min(max(sh.widths.get(2, 0), 14), 40)

        rr += 1
        headers = ["No."] + res["headers"]
        sh.row(rr, headers, S_HEADER)
        hrow = rr
        if res["rows"]:
            for k, row in enumerate(res["rows"], 1):
                rr += 1
                sh.set(rr, 1, k, S_INT)
                for j, v in enumerate(row):
                    sh.set(rr, j + 2, v, S_CELL)
            sh.autofilter = "A%d:%s" % (hrow, ref(rr, len(headers)))
        else:
            rr += 1
            sh.set(rr, 1, "No items found." if res["status"] not in ("SKIPPED", "ERROR") else "-", S_SUB)
        sh.freeze_row = hrow
        sh.widths[1] = max(sh.widths.get(1, 0), 22)
        sheets.append(sh)

    # ---------------- Rule Settings (audit trail) ----------------
    rs = Sheet(sheet_name("Rule Settings", used))
    rs.tab = "FF7F7F7F"
    rs.set(1, 1, "Rule Settings used for this run (defined in Dynamo)", S_TITLE)
    rs.link(2, 1, "<< Back to Summary", "Summary", S_LINK)
    rr = 4
    rs.row(rr, ["No.", "Heading", "Section", "Check", "Type", "Enabled", "Required", "Mode",
                "Element Type", "Categories", "Filters"], S_HEADER)
    hrow = rr
    for i, c in enumerate(checks, 1):
        rr += 1
        cats = ", ".join(resolve_category(x)[1] or str(x) for x in c["categories"])
        flt = "\n".join("%s%s [%s] %s '%s'%s" % ("" if k == 0 else f["op"].upper() + " ",
                                                    f["src"], f["prop"], f["cond"], f["val"],
                                                    " (ci)" if f["ci"] else "")
                         for k, f in enumerate(c["filters"]))
        rs.row(rr, [(i, S_INT), c["heading"], c["section"], (c["name"], S_BOLD), c["ctype"],
                    yn(c["enabled"]), yn(c["required"]), c["mode"].capitalize(),
                    c["element_type"].capitalize() if c["ctype"] == "Custom" else "",
                    (cats, S_WRAP), (flt, S_WRAP)], S_CELL)
    rs.autofilter = "A%d:%s" % (hrow, ref(rr, 11))
    rs.freeze_row = hrow
    rs.widths[10] = 60
    rs.widths[11] = 50
    sheets.append(rs)

    save_xlsx(out_path, sheets)
    return overall, npass, len(scored)

# =====================================================================
# MAIN  (single model or batch of RVT files opened in the background)
# =====================================================================
def _in(i, default=None):
    try:
        v = IN[i]
        return default if v is None or v == "" else v
    except Exception:
        return default


def set_document(d):
    """Point every check at document d and clear per-document caches."""
    global doc, _cat_by_name
    doc = d
    _cat_by_name = None
    _type_cache.clear()
    _name_cache.clear()
    _ws_cache.clear()


BACKUP_RE = re.compile(r"\.\d{4}\.rvt$", re.I)


def collect_rvt(src, msgs):
    items = to_py(src)
    if not isinstance(items, list):
        items = [items]
    flat = []

    def _f(x):
        if isinstance(x, list):
            for v in x:
                _f(v)
        elif x is not None and str(x).strip():
            flat.append(str(x).strip().strip('"'))
    _f(items)
    files = []
    for p in flat:
        if os.path.isdir(p):
            if INCLUDE_SUBFOLDERS:
                for root, _, names in os.walk(p):
                    files += [os.path.join(root, n) for n in sorted(names) if n.lower().endswith(".rvt")]
            else:
                files += [os.path.join(p, n) for n in sorted(os.listdir(p)) if n.lower().endswith(".rvt")]
        elif os.path.isfile(p) and p.lower().endswith(".rvt"):
            files.append(p)
        else:
            msgs.append("Not found / not an .rvt: %s" % p)
    if SKIP_BACKUP_FILES:
        files = [f for f in files if not BACKUP_RE.search(f)]
    seen, out = set(), []
    for f in files:
        k = os.path.normcase(os.path.abspath(f))
        if k not in seen:
            seen.add(k)
            out.append(f)
    return out


def open_background(app, path):
    mp = DB.ModelPathUtils.ConvertUserVisiblePathToModelPath(path)
    opt = DB.OpenOptions()
    opt.Audit = AUDIT_ON_OPEN
    info = None
    try:
        info = DB.BasicFileInfo.Extract(path)
    except Exception:
        pass
    if info is not None and info.IsWorkshared:
        opt.DetachFromCentralOption = (DB.DetachFromCentralOption.DetachAndPreserveWorksets
                                       if DETACH_FROM_CENTRAL else DB.DetachFromCentralOption.DoNotDetach)
        opt.SetOpenWorksetsConfiguration(DB.WorksetConfiguration(
            DB.WorksetConfigurationOption.OpenAllWorksets if OPEN_ALL_WORKSETS
            else DB.WorksetConfigurationOption.CloseAllWorksets))
    return app.OpenDocumentFile(mp, opt)


def out_path_for(out, title, stamp, batch, src_path=None):
    fname = "%s_ModelCheck_%s.xlsx" % (re.sub(r'[\\/:*?"<>|]', "_", title), stamp.strftime("%Y%m%d_%H%M"))
    if out:
        out = str(out)
        if out.lower().endswith(".xlsx"):
            if not batch:
                return out
            out = os.path.dirname(out)
        if not os.path.isdir(out):
            os.makedirs(out)
        return os.path.join(out, fname)
    base = src_path or doc.PathName
    folder = os.path.dirname(base) if base and os.path.isdir(os.path.dirname(base)) \
        else os.path.join(os.path.expanduser("~"), "Desktop")
    return os.path.join(folder, fname)


def check_document(checks, out, batch, src_path=None):
    """Run all checks on the current global doc and write its xlsx."""
    meta = {"name": REPORT_TITLE, "author": REPORT_AUTHOR,
            "file": "defined in Dynamo graph (%d rules, %d enabled)"
                    % (len(checks), len([c for c in checks if c["enabled"]]))}
    title = doc.Title or "Model"
    if title.lower().endswith(".rvt"):
        title = title[:-4]
    stamp = datetime.datetime.now()
    path = out_path_for(out, title, stamp, batch, src_path)

    results = [run_check(c) for c in checks]

    model = [("Model", title),
             ("File Path", src_path or doc.PathName or "(not saved / cloud)"),
             ("Revit Version", "%s (%s)" % (doc.Application.VersionName, doc.Application.VersionBuild)),
             ("Workshared", yn(doc.IsWorkshared)),
             ("Run By", doc.Application.Username),
             ("Run Time", stamp.strftime("%Y-%m-%d %H:%M")),
             ("Run Mode", "Batch - opened in background%s" % (" (detached)" if DETACH_FROM_CENTRAL else "")
              if batch else "Current model"),
             ("Rule Set", "%s  (rules defined in Dynamo)" % REPORT_TITLE)]
    overall, npass, nscored = build_report(meta, model, checks, results, path)
    return path, results, overall, npass, nscored


def main():
    global OPEN_WHEN_DONE
    raw_rules = _in(0, None)
    out = _in(1, None)
    msgs = apply_options(_in(2, None))
    rvt_src = _in(3, None)

    checks, rmsgs = parse_rules(raw_rules)
    msgs += rmsgs
    if not checks:
        return ["No rules received on IN[0]. Connect the 'All Rules' node.", None, msgs]
    if not SHOW_DISABLED_CHECKS:
        checks = [c for c in checks if c["enabled"]]
        if not checks:
            return ["All rules are disabled.", None, msgs]

    # ------------------------------------------------ single (current model)
    if not rvt_src:
        path, results, overall, npass, nscored = check_document(checks, out, False)
        if OPEN_WHEN_DONE:
            try:
                os.startfile(path)
            except Exception:
                pass
        summary = [["Check", "Status", "In Scope", "Issues", "Completion"]]
        for c, r in zip(checks, results):
            summary.append([c["name"], r["status"], r["checked"], r["failed"] if r["mode"] != "info" else r["found"],
                            "" if r["completion"] is None else "%.1f%%" % (r["completion"] * 100)])
        summary.append(["OVERALL", "%d/%d passed" % (npass, nscored), "", "",
                        "" if overall is None else "%.1f%%" % (overall * 100)])
        return [path, summary, msgs or ["All rules valid."]]

    # ------------------------------------------------ batch
    files = collect_rvt(rvt_src, msgs)
    if not files:
        return ["No .rvt files found on IN[3].", None, msgs]
    home = doc
    app = home.Application
    open_paths = set(os.path.normcase(d.PathName) for d in app.Documents if d.PathName)
    TransactionManager.Instance.ForceCloseTransaction()

    paths = []
    table = [["File", "Result", "Checks Passed", "Overall Completion", "Report / Error", "Time (s)"]]
    for f in files:
        t0 = datetime.datetime.now()
        bdoc, opened_here = None, False
        try:
            if os.path.normcase(f) in open_paths:
                bdoc = [d for d in app.Documents if os.path.normcase(d.PathName or "") == os.path.normcase(f)][0]
            else:
                bdoc = open_background(app, f)
                opened_here = True
            if bdoc.IsFamilyDocument:
                raise Exception("Family document - skipped")
            set_document(bdoc)
            path, results, overall, npass, nscored = check_document(checks, out, True, f)
            paths.append(path)
            table.append([os.path.basename(f), "OK", "%d/%d" % (npass, nscored),
                          "" if overall is None else "%.1f%%" % (overall * 100), path,
                          round((datetime.datetime.now() - t0).total_seconds(), 1)])
        except Exception as ex:
            paths.append(None)
            table.append([os.path.basename(f), "ERROR", "", "", str(ex).splitlines()[0] if str(ex) else repr(ex),
                          round((datetime.datetime.now() - t0).total_seconds(), 1)])
        finally:
            set_document(home)
            if bdoc is not None and opened_here:
                try:
                    bdoc.Close(False)          # never save
                except Exception as ex:
                    msgs.append("Could not close %s: %s" % (os.path.basename(f), ex))

    ok = [p for p in paths if p]
    if OPEN_WHEN_DONE and ok:
        try:
            os.startfile(os.path.dirname(ok[0]))   # open the output folder
        except Exception:
            pass
    msgs.append("Batch done: %d file(s), %d report(s), %d error(s)." % (len(files), len(ok), len(files) - len(ok)))
    return [paths, table, msgs]


OUT = main()
# ----------------------------------------
result_xlsx_path_s_summary = Watch(aa_model_checker_rules_in_dynamo)  # "Result [xlsx path(s), summary, messages]"
